# Grasshopper definition FlexiFab.gh (Grasshopper 1.0.8)
# plug-ins: DKUI.Components, Fologram For Grasshopper Utilities, LunchBox, Pancake, Wombat, Sasquatch

dk_ns_import_model = Panel("False")
dk_button = DKButton(Name="Import Model", Value=dk_ns_import_model)  # -> Button, Value
dk_h2_text = DKH2Text(Text="Import Model")
dk_p_text = DKPText(Text="In Rhino Viewport, please use Gumball to rotate your model")
select_type_of_object = ValueList({"Any": 0, "Point": 1, "Curve": 4, "Brep": 24, "Mesh": 32}, selected="Brep")
boolean = Boolean(dk_button.Value)
merge = Merge(Data1=flatten(dk_h2_text), Data2=flatten(dk_button.Button), Data3=flatten(dk_p_text))
dk_geometry = Panel("04e71af8-7e6a-48ef-9d7e-7284f2544f71")
dk_get_object = DKGetObject(Name="Geometry", Get_object=boolean, Value=dk_geometry, Geo_filter=select_type_of_object, Clear=Button())

boolean_toggle = BooleanToggle(False)
boolean_toggle_2 = BooleanToggle(False)
panel = Panel("26929")

panel_2 = Panel("""Import Model
Gloal Settings
Local Settings
Export""")
dk__3f = Panel("1")
dk_tab_control_2 = DKTabControl2(Name="?", Tab_names=panel_2, Value=dk__3f)  # -> Tab_head, Value

dk_file_path = Panel("")
dk_ns_assembly_preview = Panel("False")
dk_ns_assembly_export = Panel("False")
dk_button_2 = DKButton(Name="Assembly Preview", Value=dk_ns_assembly_preview)  # -> Button, Value
dk_button_3 = DKButton(Name="Assembly Export", Value=dk_ns_assembly_export)  # -> Button, Value
dk_text_box = DKTextBox(Name="File path", Value=dk_file_path)  # -> Text_box, Value
dk_h2_text_2 = DKH2Text(Text="Generate and Preview Assembly")
merge_2 = Merge(
    Data1=flatten(dk_h2_text_2),
    Data2=flatten(dk_button_2.Button),
    Data3=flatten(dk_text_box.Text_box),
    Data4=flatten(dk_button_3.Button))

number_slider = Slider(1, range=0..3)
geometry = Geometry(dk_get_object)
geometry_2 = Geometry(<surface referenced from the Rhino model>)
geometry_3 = Geometry(geometry)
brep = Brep(geometry_3)
brep_edges = BrepEdges(Brep=brep)  # -> Naked, Interior, NonManifold
boundary_surfaces = BoundarySurfaces(Edges=brep_edges.Naked)

dk_grid_spacing = Panel("24")
dk_number_slider = DKNumberSlider(Name="Grid Spacing", Min_num=Slider(1, range=0..1), Max_num=Slider(60, range=0..60), Value=dk_grid_spacing)  # -> Slider, Value

merge_3 = Merge(Data1=boundary_surfaces, Data2=brep)
brep_join = BrepJoin(Breps=flatten(merge_3))  # -> Breps, Closed
box = Box(brep_join.Breps)
deconstruct_box = DeconstructBox(Box=box)  # -> Plane, X, Y, Z
number_slider_2 = Slider(5, range=0..10)
deconstruct_domain = DeconstructDomain(Domain=deconstruct_box.X)  # -> Start, End
deconstruct_domain_2 = DeconstructDomain(Domain=deconstruct_box.Y)  # -> Start, End
deconstruct_domain_3 = DeconstructDomain(Domain=deconstruct_box.Z)  # -> Start, End
expression = Expression(x=deconstruct_domain.Start, y=deconstruct_domain.End, z=dk_number_slider.Value, Expression="(y-x)/z\1")
expression_2 = Expression(x=deconstruct_domain_2.Start, y=deconstruct_domain_2.End, z=dk_number_slider.Value, Expression="(y-x)/z\1")
construct_point = ConstructPoint(XCoordinate=deconstruct_domain.Start, YCoordinate=deconstruct_domain_2.Start, ZCoordinate=deconstruct_domain_3.Start)
construct_point_2 = ConstructPoint(XCoordinate=deconstruct_domain.End, YCoordinate=deconstruct_domain_2.Start, ZCoordinate=deconstruct_domain_3.End)
expression_3 = Expression(x=deconstruct_domain.Start, y=deconstruct_domain.End, slice_x=expression, Expression="(y-x)/slice_x")
construct_point_3 = ConstructPoint(XCoordinate=deconstruct_domain.Start, YCoordinate=deconstruct_domain_2.Start, ZCoordinate=deconstruct_domain_3.Start)
construct_point_4 = ConstructPoint(XCoordinate=deconstruct_domain.Start, YCoordinate=deconstruct_domain_2.End, ZCoordinate=deconstruct_domain_3.End)
expression_4 = Expression(x=deconstruct_domain_2.Start, y=deconstruct_domain_2.End, slice_x=expression_2, Expression="(y-x)/slice_x")
line = Line(StartPoint=construct_point, EndPoint=construct_point_2)
line_2 = Line(StartPoint=construct_point_3, EndPoint=construct_point_4)
midpoint = Midpoint(Curve=line)
midpoint_2 = Midpoint(Curve=line_2)
xz_plane = XZPlane(Origin=midpoint)
yz_plane = YZPlane(Origin=midpoint_2)
rectangle_2pt = Rectangle2Pt(Plane=xz_plane, PointA=construct_point, PointB=construct_point_2, Radius=0)  # -> Rectangle, Length
rectangle_2pt_2 = Rectangle2Pt(Plane=yz_plane, PointA=construct_point_3, PointB=construct_point_4, Radius=0)  # -> Rectangle, Length
boundary_surfaces_2 = BoundarySurfaces(Edges=rectangle_2pt_2.Rectangle)
unit_y = UnitY(Factor=expression_4)
boundary_surfaces_3 = BoundarySurfaces(Edges=rectangle_2pt.Rectangle)
boundary_surfaces_4 = BoundarySurfaces(Edges=rectangle_2pt.Rectangle)
unit_x = UnitX(Factor=expression_3)
addition = Addition(A=expression_2, B=1)
addition_2 = Addition(A=expression, B=1)
area = Area(Geometry=boundary_surfaces_2)  # -> Area, Centroid
area_2 = Area(Geometry=boundary_surfaces_4)  # -> Area, Centroid
scale = Scale(Geometry=boundary_surfaces_2, Center=area.Centroid, Factor=1.1)  # -> Geometry, Transform
linear_array = LinearArray(Geometry=scale.Geometry, Direction=unit_x, Count=addition_2)  # -> Geometry, Transform
scale_2 = Scale(Geometry=boundary_surfaces_4, Center=area_2.Centroid, Factor=1.1)  # -> Geometry, Transform
linear_array_2 = LinearArray(Geometry=scale_2.Geometry, Direction=unit_y, Count=addition)  # -> Geometry, Transform
division = Division(A=unit_x, B=2)
split_brep_multiple = SplitBrepMultiple(Brep=brep_join.Breps, Cutters=linear_array_2.Geometry)
move = Move(Geometry=linear_array.Geometry, Motion=division)  # -> Geometry, Transform
split_brep_multiple_2 = SplitBrepMultiple(Brep=brep_join.Breps, Cutters=move.Geometry)
brep_edges_2 = BrepEdges(Brep=split_brep_multiple)  # -> Naked, Interior, NonManifold
brep_edges_3 = BrepEdges(Brep=split_brep_multiple_2)  # -> Naked, Interior, NonManifold
join_curves = JoinCurves(Curves=brep_edges_2.Naked, Preserve=False)
join_curves_2 = JoinCurves(Curves=brep_edges_3.Naked, Preserve=False)
list_item = ListItem(List=join_curves_2, Index=0, Wrap=True)
sort_duplicate_curves = SortDuplicateCurves(Curves=join_curves)  # -> UniqueCurves, Indices
list_item_2 = ListItem(List=join_curves, Index=0, Wrap=True)
sort_duplicate_curves_2 = SortDuplicateCurves(Curves=flatten(join_curves))  # -> UniqueCurves, Indices
sort_duplicate_curves_3 = SortDuplicateCurves(Curves=flatten(list_item))  # -> UniqueCurves, Indices
length = Length(Curve=sort_duplicate_curves_3.UniqueCurves)
length_2 = Length(Curve=sort_duplicate_curves_2.UniqueCurves)
geometry_4 = Geometry(sort_duplicate_curves_2.UniqueCurves)
unit_z = UnitZ(Factor=1)
expression_5 = Expression(x=length_2, Expression="If(x<10, true, false)")
dispatch = Dispatch(List=sort_duplicate_curves_2.UniqueCurves, DispatchPattern=expression_5)  # -> ListA, ListB
box_2 = Box(sort_duplicate_curves_3.UniqueCurves)
geometry_5 = Geometry(sort_duplicate_curves_3.UniqueCurves)
area_3 = Area(Geometry=dispatch.ListB)  # -> Area, Centroid
area_4 = Area(Geometry=sort_duplicate_curves_3.UniqueCurves)  # -> Area, Centroid
rotate_direction = RotateDirection(Geometry=dispatch.ListB, Center=area_3.Centroid, From=unit_y, To=unit_z)  # -> Geometry, Transform
rotate_direction_2 = RotateDirection(Geometry=sort_duplicate_curves_3.UniqueCurves, Center=area_4.Centroid, From=unit_x, To=unit_z)  # -> Geometry, Transform
boundary_surfaces_5 = BoundarySurfaces(Edges=rotate_direction_2.Geometry)
boundary_surfaces_6 = BoundarySurfaces(Edges=rotate_direction.Geometry)
length_3 = Length(Curve=rotate_direction_2.Geometry)
sort_duplicate_breps = SortDuplicateBreps(Breps=boundary_surfaces_6)  # -> UniqueBreps, Indices
sort_duplicate_breps_2 = SortDuplicateBreps(Breps=boundary_surfaces_5)  # -> UniqueBreps, Indices
expression_6 = Expression(x=length_3, Expression="If(x<10, true, false)")
geometry_6 = Geometry(sort_duplicate_curves_3.UniqueCurves)
number_slider_3 = Slider(0, range=-20..20)
brep_edges_4 = BrepEdges(Brep=sort_duplicate_breps.UniqueBreps)  # -> Naked, Interior, NonManifold
brep_edges_5 = BrepEdges(Brep=sort_duplicate_breps_2.UniqueBreps)  # -> Naked, Interior, NonManifold
geometry_7 = Geometry(sort_duplicate_curves_2.UniqueCurves)
curve_curve = CurveCurve(CurveA=geometry_7, CurveB=graft(geometry_6))  # -> Points, ParamsA, ParamsB
join_curves_3 = JoinCurves(Curves=brep_edges_5.Naked, Preserve=False)  # -> flatten(Curves)
join_curves_4 = JoinCurves(Curves=brep_edges_4.Naked, Preserve=False)  # -> flatten(Curves)
list_item_3 = ListItem(List=curve_curve.Points, Index=0, Wrap=True)  # -> Item, Item1
boundary_surfaces_7 = BoundarySurfaces(Edges=flatten(geometry_7))
boundary_surfaces_8 = BoundarySurfaces(Edges=flatten(geometry_6))
box_3 = Box(boundary_surfaces_7)
vector_2pt = Vector2Pt(PointA=list_item_3.Item, PointB=list_item_3.Item1, Unitize=False)  # -> Vector, Length
line_3 = Line(StartPoint=list_item_3.Item, EndPoint=list_item_3.Item1)
unit_z_2 = UnitZ(Factor=1)
deconstruct_box_2 = DeconstructBox(Box=box_3)  # -> Plane, X, Y, Z
box_4 = Box(boundary_surfaces_8)
brep_edges_6 = BrepEdges(Brep=boundary_surfaces_7)  # -> Naked, Interior, NonManifold
deconstruct_box_3 = DeconstructBox(Box=box_4)  # -> Plane, X, Y, Z
deconstruct_domain_4 = DeconstructDomain(Domain=deconstruct_box_2.Z)  # -> Start, End
multiplication = Multiplication(A=vector_2pt.Vector, B=unit_z_2)
deconstruct_domain_5 = DeconstructDomain(Domain=deconstruct_box_3.Z)  # -> Start, End
number_slider_4 = Slider(6, range=0..10)
brep_edges_7 = BrepEdges(Brep=boundary_surfaces_8)  # -> Naked, Interior, NonManifold
flip_curve = FlipCurve(Curve=line_3)  # -> Curve, Flag
expression_7 = Expression(x=multiplication, Expression="If(x>0, 1, 0)")
unit_z_3 = UnitZ(Factor=1)
merge_4 = Merge(Data1=flip_curve.Curve, Data2=line_3)
yz_plane_2 = YZPlane(Origin=Point(0, 0, 0))
list_item_4 = ListItem(List=merge_4, Index=expression_7, Wrap=True)
end_points = EndPoints(Curve=list_item_4)  # -> Start, End
merge_5 = Merge(Data1=end_points.Start, Data2=end_points.End)
prune_tree = PruneTree(Tree=merge_5, Minimum=1, Maximum=0)
list_item_5 = ListItem(List=prune_tree, Index=0, Wrap=True)  # -> Item, Item1
vector_2pt_2 = Vector2Pt(PointA=list_item_5.Item, PointB=list_item_5.Item1, Unitize=False)  # -> Vector, Length
number_slider_5 = Slider(3.2, range=0..10)
xz_plane_2 = XZPlane(Origin=Point(0, 0, 0))
rectangle_2pt_3 = Rectangle2Pt(Plane=yz_plane_2, PointA=Point(0, 0, 0), PointB=Point(0, 1, 1), Radius=0)  # -> Rectangle, Length
rectangle_2pt_4 = Rectangle2Pt(Plane=xz_plane_2, PointA=Point(0, 0, 0), PointB=Point(1, 0, 1), Radius=0)  # -> Rectangle, Length
expression_8 = Expression(x=number_slider_5, Expression="-x/2")
join_curves_5 = JoinCurves(Curves=brep_edges_6.Naked, Preserve=False)
unit_x_2 = UnitX(Factor=expression_8)
unit_y_2 = UnitY(Factor=expression_8)
join_curves_6 = JoinCurves(Curves=brep_edges_7.Naked, Preserve=False)
join_curves_7 = JoinCurves(Curves=brep_edges_7.Naked, Preserve=False)
negative = Negative(Value=unit_x_2)
extrude = Extrude(Base=join_curves_5, Direction=unit_y_2)
negative_2 = Negative(Value=unit_y_2)
extrude_2 = Extrude(Base=join_curves_5, Direction=negative_2)
cap_holes = CapHoles(Brep=extrude)
extrude_3 = Extrude(Base=join_curves_7, Direction=unit_x_2)
cap_holes_2 = CapHoles(Brep=extrude_2)
extrude_4 = Extrude(Base=join_curves_7, Direction=negative)
geometry_8 = Geometry(boundary_surfaces_8)
cap_holes_3 = CapHoles(Brep=extrude_3)
cap_holes_4 = CapHoles(Brep=extrude_4)
negative_3 = Negative(Value=unit_y_2)
unit_x_3 = UnitX(Factor=1)
unit_y_3 = UnitY(Factor=1)
number_slider_6 = Slider(20, range=0..100)

dk_h2_text_3 = DKH2Text(Text="Global Settings")

number = Number(dk_number_slider.Value)
number_slider_7 = Slider(12, range=0..100)
division_2 = Division(A=number, B=2)

dk_stiffness_coefficient = Panel("0.77")
dk_number_slider_2 = DKNumberSlider(Name="Stiffness Coefficient", Min_num="0", Max_num="1.0", Step="0.01", Value=dk_stiffness_coefficient)  # -> Slider, Value

number_slider_8 = Slider(4, range=0..10)
number_slider_9 = Slider(0, range=0..100)
multiplication_2 = Multiplication(A=number_slider_8, B=2)
dk_ns_animation = Panel("False")
dk_animation = Panel("True")
dk_button_4 = DKButton(Name="Animation", Value=dk_ns_animation)  # -> Button, Value
dk_check_box = DKCheckBox(Name="Animation", Value=dk_animation)  # -> Check_box, Value

dk_range_of_compression_coefficient = Panel("9.5")
dk_number_slider_3 = DKNumberSlider(
    Name="Range of Compression Coefficient",
    Min_num="1.0",
    Max_num="10.0",
    Step="0.1",
    Value=dk_range_of_compression_coefficient)  # -> Slider, Value

dk_ns_preview = Panel("False")
dk_button_5 = DKButton(Name="Preview", Value=dk_ns_preview)  # -> Button, Value

record_data = RecordData(Data=dk_button_5.Value, Record=True, Reset=Button(), RecordFirstDataOnReset=True)
colour_picker = ColourPicker(PickedColour=RGB(145, 145, 145))
panel_3 = Panel(record_data)
dk_window_style_light = DKWindowStyleLight(Back_ground="#FFFFFF", Font_size="28")
trigger = Trigger(Interval=100, TimerInterval=100, Target=time)
open_flexifab_ui = BooleanToggle(True)
deconstruct = Deconstruct()  # -> XComponent, YComponent, ZComponent
time = Time()
addition_3 = Addition(A=deconstruct.XComponent, B=deconstruct.YComponent)
boolean_toggle_3 = BooleanToggle(False)
dy = Slider(8, range=0..100)
dx = Slider(24.649, range=0..30)
construct_point_5 = ConstructPoint(XCoordinate=addition_3, YCoordinate=deconstruct.YComponent, ZCoordinate=deconstruct.ZComponent)
r3 = Slider(10.268, range=0..20)
construct_domain = ConstructDomain(DomainStart=Slider(0, range=-1..1), DomainEnd=Slider(0, range=-1..1))
number_2 = Number(dk_number_slider_2.Value)
construct_domain_2 = ConstructDomain(DomainStart=Slider(0, range=-1..1), DomainEnd=Slider(0, range=-1..1))
vector_xyz = VectorXYZ(XComponent=0, YComponent=0, ZComponent=0)  # -> Vector, Length
radians = Radians(Degrees=90)
negative_4 = Negative(Value=radians)
construct_point_6 = ConstructPoint(XCoordinate=0, YCoordinate=0, ZCoordinate=0)
construct_domain_3 = ConstructDomain(DomainStart=negative_4, DomainEnd=radians)
unit_x_4 = UnitX(Factor=1)
merge_6 = Merge(Data1=join_curves_3, Data2=rotate_direction.Geometry)
number_slider_10 = Slider(12, range=0..100)
duplicate_data = DuplicateData(Data=multiplication_2, Number=Slider(12, range=0..100), Order=True)
number_slider_11 = Slider(0, range=0..100)
mass_addition = MassAddition(Input=duplicate_data)  # -> Result, PartialResults
number_slider_12 = Slider(0, range=0..100)
merge_7 = Merge(Data1=number_slider_11, Data2=mass_addition.PartialResults)  # -> flatten(Result)
unit_y_4 = UnitY(Factor=merge_7)
unit_x_5 = UnitX(Factor=1)
numbers_to_points = NumbersToPoints(Numbers=[0, 0, 0], Mask=4)

grid = Geometry([<curve referenced from the Rhino model> x14])
t_preview = Geometry([<extrusion referenced from the Rhino model> x2, <brep referenced from the Rhino model>, <extrusion referenced from the Rhino model>, <brep referenced from the Rhino model>, <extrusion referenced from the Rhino model> x9])
untunable = Geometry([<curve referenced from the Rhino model> x512])
tunable = Geometry([<curve referenced from the Rhino model> x390])
ut_preview = Geometry([<extrusion referenced from the Rhino model> x2, <brep referenced from the Rhino model>, <extrusion referenced from the Rhino model>, <brep referenced from the Rhino model>, <extrusion referenced from the Rhino model> x9])
merge_8 = Merge(Data1=tunable, Data2=t_preview)
merge_9 = Merge(Data1=untunable, Data2=ut_preview)
colour_picker_2 = ColourPicker(PickedColour=RGBA(67, 0, 146, 123))

trigger_2 = Trigger(Interval=10, TimerInterval=10, Target=counter)
button = Button()
counter = Counter(Reset=dk_button_4.Value)
number_3 = Number(dk_tab_control_2.Value)
integer = Integer(dk_tab_control_2.Value)
null = Null(Count=1)
expression_9 = Expression(x=integer, y=dk_check_box.Value, Expression="If(x=2 , 1, 0)")
gate_or = GateOr(A=expression_9, B=dk_check_box.Value)
integer_2 = Integer(gate_or)
negative_5 = Negative(Value=Slider(10, range=0..10))
unit_x_6 = UnitX(Factor=3.2)
negative_6 = Negative(Value=unit_x_6)
expression_10 = Expression(Expression="Format(\"{0}, {1}\", x, y)")
dxf_export_option = DXFExportOption(Scheme="Default", LastSaveLocalization="neutral,N")

# ---- group: UNIT PERIOD: k x GridSpacing + b
unitperiodfactor_k = Slider(1, range=0.25..1.5)
unitperiodoffset_mm = Slider(0, range=-10..10)
gridspacing_x_k = Multiplication(A=dk_number_slider.Value, B=unitperiodfactor_k)
unitperiod_k_gridspacing_b = Addition(A=gridspacing_x_k, B=unitperiodoffset_mm)
unitperiod_mm = Panel(unitperiod_k_gridspacing_b)

# ----
expression_11 = Expression(x=unitperiod_k_gridspacing_b, Expression="x/2")
expression_12 = Expression(x=unitperiod_k_gridspacing_b, Expression="x/4")
expression_13 = Expression(dy=expression_12, k_coef=dk_number_slider_2.Value, Expression="-dy*k_coef/3+dy/2")
expression_14 = Expression(x=expression_11, Expression="(x-0.5)*2")
expression_15 = Expression(x=expression_11, Expression="x")
expression_16 = Expression(
    R2=expression_15,
    y=number_slider_8,
    x=expression_11,
    dx=expression_14,
    R1=expression_13,
    Expression="sqrt((R2+y)²+(x-dx/2+R1)²)")
expression_17 = Expression(R2=expression_15, y=number_slider_8, x=expression_11, Expression="sqrt((2*R2)²+x²)-2*R2")
panel_4 = Panel(expression_13)
expression_18 = Expression(gs=unitperiod_k_gridspacing_b, R_coef=dk_number_slider_3.Value, Expression="gs/R_coef*2")
expression_19 = Expression(r2=expression_15, dy=number_slider_8, Expression="dy/2-r2")
expression_20 = Expression(dx=expression_14, R1=expression_13, Expression="dx/2-R1")
expression_21 = Expression(dx=expression_14, R1=expression_13, Expression="dx-R1")
expression_22 = Expression(dx=expression_14, r1=expression_11, Expression="(dx-0.5)/2")
arc = Arc(Plane=PlaneXY(0, 0, 0), Radius=expression_13, Angle=Domain(0, 3.141592654))  # -> Arc, Length
panel_5 = Panel(expression_20)
vector_xyz_2 = VectorXYZ(XComponent=expression_11, YComponent=number_slider_8, ZComponent=0)  # -> Vector, Length
vector_xyz_3 = VectorXYZ(XComponent=expression_20, YComponent=0, ZComponent=0)  # -> Vector, Length
line_sdl = LineSDL(Start=construct_point_6, Direction=unit_x_4, Length=expression_15)
move_2 = Move(Geometry=arc.Arc, Motion=vector_xyz_3.Vector)  # -> Geometry, Transform
multiplication_3 = Multiplication(A=expression_11, B=2)
multiplication_4 = Multiplication(A=expression_11, B=2)
duplicate_data_2 = DuplicateData(Data=multiplication_3, Number=Slider(6, range=0..100), Order=True)
mass_addition_2 = MassAddition(Input=duplicate_data_2)  # -> Result, PartialResults
merge_10 = Merge(Data1=number_slider_11, Data2=mass_addition_2.PartialResults)  # -> flatten(Result)
unit_x_7 = UnitX(Factor=merge_10)
addition_4 = Addition(A=graft(unit_x_7), B=unit_y_4)
panel_6 = Panel(expression_11)
threadlength = Slider(26.5, range=0..60)
smoothlength = Slider(3.5, range=0.5..15)
thickness = Slider(3.175, range=1..8)
clearance = Slider(0.025, range=0..0.5)
pitch = Slider(1.75, range=1..3)
rootradius = Slider(4.6, range=3..8)
crestradius = Slider(5.721, range=4..10)
tolerance = Slider(0.01, range=0.001..0.1)
topmargin_mm = Slider(18, range=0..30)
rootmargin_mm = Slider(12, range=0..40)
openbasedepth_mm = Slider(0, range=0..100)
shortthreadlength_mm = Slider(3.5, range=0.25..12)
necklength_mm = Slider(10, range=0..25)
dk_grid_phase_x = Slider(0.1, range=-1..1)
dk_grid_phase_y = Slider(0, range=-1..1)
dk_remove_narrow_edges = BooleanToggle(True)
dk_edge_width_ratio = Slider(0, range=0..1)
toponly = BooleanToggle(True)
grid_phase_x_ui = DKNumberSlider(
    Name="Grid Phase X",
    Min_num="-1",
    Max_num="1",
    Step="0.01",
    Value=dk_grid_phase_x,
    Tool_tip="Move the section grid, not the unit shape. 0 centers the fixed-count grid; -/+ moves along -/+ axes. The curved model footprint limits the actual travel.")  # -> Slider, Value
grid_phase_y_ui = DKNumberSlider(
    Name="Grid Phase Y",
    Min_num="-1",
    Max_num="1",
    Step="0.01",
    Value=dk_grid_phase_y,
    Tool_tip="Move the section grid, not the unit shape. 0 centers the fixed-count grid; -/+ moves along -/+ axes. The curved model footprint limits the actual travel.")  # -> Slider, Value
edge_width_ratio_ui = DKNumberSlider(
    Name="Edge Width Ratio",
    Min_num="0",
    Max_num="1",
    Step="0.01",
    Value=dk_edge_width_ratio,
    Tool_tip="Threshold = ratio x original unit width, measured from outside slot wall to panel edge. Default 0.78; used only when Remove Narrow Edges is enabled.")  # -> Slider, Value
omit_edge_joints_ui = DKCheckBox(
    Name="Omit Edge Joints",
    Value=dk_remove_narrow_edges,
    Tool_tip="Apply to all sheets: omit the edge slot and tab if its outer bay is narrow. Keep the entire panel outline and continue the original unit lattice; no side trimming. Retained sheets can still intersect in Assembly.")  # -> Check_box, Value

dk_tunable_3f = Panel("True")
dk_local_stiffness_multiplier = Panel("1.36")
dk_interface_z_level_28mm_29 = Panel("9")
dk_check_box_2 = DKCheckBox(Name="Tunable?", Value=dk_tunable_3f)  # -> Check_box, Value
dk_number_slider_4 = DKNumberSlider(
    Name="Interface Z Level (mm)",
    Min_num=Slider(0, range=0..100),
    Max_num=Slider(10, range=0..10),
    Value=dk_interface_z_level_28mm_29)  # -> Slider, Value
dk_number_slider_5 = DKNumberSlider(
    Name="Local Stiffness Multiplier",
    Min_num=Slider(0.5, range=0..1),
    Max_num=Slider(1.5, range=0..10),
    Step=Slider(0.01, range=0..0.01),
    Value=dk_local_stiffness_multiplier)  # -> Slider, Value
dk_h2_text_4 = DKH2Text(Text="Local Settings and Preview")

negative_7 = Negative(Value=dk_number_slider_4.Value)
line_sdl_2 = LineSDL(Start=list_item_5.Item1, Direction=vector_2pt_2.Vector, Length=negative_7)
end_points_2 = EndPoints(Curve=line_sdl_2)  # -> Start, End
surface_closest_point = SurfaceClosestPoint(Point=flatten(end_points_2.End), Surface=graft(boundary_surfaces_8))  # -> Point, UVPoint, Distance
surface_closest_point_2 = SurfaceClosestPoint(Point=flatten(end_points_2.End), Surface=graft(boundary_surfaces_7))  # -> Point, UVPoint, Distance
expression_23 = Expression(x=surface_closest_point.Distance, Expression="x<1e-2")
expression_24 = Expression(x=surface_closest_point_2.Distance, Expression="x<1e-2")
cull_pattern = CullPattern(List=surface_closest_point.Point, CullPattern=expression_23)
cull_pattern_2 = CullPattern(List=surface_closest_point_2.Point, CullPattern=expression_24)
deconstruct_2 = Deconstruct(Point=cull_pattern)  # -> XComponent, YComponent, ZComponent
deconstruct_3 = Deconstruct(Point=cull_pattern_2)  # -> XComponent, YComponent, ZComponent
expression_25 = Expression(x=graft(deconstruct_domain_5.End), y=deconstruct_2.ZComponent, Expression="x-y")
expression_26 = Expression(x=deconstruct_3.ZComponent, y=graft(deconstruct_domain_4.Start), Expression="x-y")
negative_8 = Negative(Value=expression_26)
scale_nu = ScaleNU(Geometry=rectangle_2pt_3.Rectangle, Plane=PlaneXY(0, 0, 0), ScaleX=1, ScaleY=number_slider_5, ScaleZ=expression_25)  # -> Geometry, Transform
scale_nu_2 = ScaleNU(Geometry=rectangle_2pt_4.Rectangle, Plane=PlaneXY(0, 0, 0), ScaleX=number_slider_5, ScaleY=1, ScaleZ=negative_8)  # -> Geometry, Transform
move_3 = Move(Geometry=scale_nu.Geometry, Motion=cull_pattern)  # -> Geometry, Transform
move_4 = Move(Geometry=scale_nu_2.Geometry, Motion=cull_pattern_2)  # -> Geometry, Transform
move_5 = Move(Geometry=move_4.Geometry, Motion=unit_x_2)  # -> Geometry, Transform
move_6 = Move(Geometry=move_3.Geometry, Motion=unit_y_2)  # -> Geometry, Transform
boundary_surfaces_9 = BoundarySurfaces(Edges=move_6.Geometry)
boundary_surfaces_10 = BoundarySurfaces(Edges=move_5.Geometry)
region_difference = RegionDifference(CurvesA=graft(boundary_surfaces_8), CurvesB=boundary_surfaces_9)
extrude_5 = Extrude(Base=boundary_surfaces_10, Direction=unit_y_2)
extrude_6 = Extrude(Base=boundary_surfaces_10, Direction=negative_2)
extrude_7 = Extrude(Base=boundary_surfaces_9, Direction=unit_x_2)
extrude_8 = Extrude(Base=boundary_surfaces_9, Direction=negative)
region_difference_2 = RegionDifference(CurvesA=graft(boundary_surfaces_7), CurvesB=boundary_surfaces_10)
cap_holes_5 = CapHoles(Brep=extrude_5)
cap_holes_6 = CapHoles(Brep=extrude_6)
cap_holes_7 = CapHoles(Brep=extrude_7)
cap_holes_8 = CapHoles(Brep=extrude_8)
solid_difference = SolidDifference(BrepsA=cap_holes, BrepsB=cap_holes_5)
solid_difference_2 = SolidDifference(BrepsA=cap_holes_2, BrepsB=cap_holes_6)
solid_difference_3 = SolidDifference(BrepsA=cap_holes_3, BrepsB=cap_holes_7)
solid_difference_4 = SolidDifference(BrepsA=cap_holes_4, BrepsB=cap_holes_8)
boundary_surfaces_11 = BoundarySurfaces(Edges=region_difference_2)
merge_11 = Merge(Data1=solid_difference, Data2=solid_difference_2)
merge_12 = Merge(Data1=solid_difference_3, Data2=solid_difference_4)
sort_duplicate_breps_3 = SortDuplicateBreps(Breps=flatten(boundary_surfaces_11))  # -> UniqueBreps, Indices
solid_union = SolidUnion(Breps=flatten(merge_11))
rotate_direction_3 = RotateDirection(Geometry=flatten(region_difference), Center=area_4.Centroid, From=unit_x, To=unit_z)  # -> Geometry, Transform
solid_union_2 = SolidUnion(Breps=flatten(merge_12))
brep_edges_8 = BrepEdges(Brep=sort_duplicate_breps_3.UniqueBreps)  # -> Naked, Interior, NonManifold
entwine = Entwine(Branch00=solid_union, Branch01=solid_union_2, FlattenInputs=True)
rotate_direction_4 = RotateDirection(Geometry=flatten(rotate_direction_3.Geometry), Center=area_3.Centroid, From=unit_y_3, To=unit_x_3)  # -> Geometry, Transform
join_curves_8 = JoinCurves(Curves=brep_edges_8.Naked, Preserve=False)
extrude_9 = Extrude(Base=join_curves_8, Direction=unit_y_2)
extrude_10 = Extrude(Base=join_curves_8, Direction=negative_3)
brep_join_2 = BrepJoin(Breps=[extrude_10, extrude_9])  # -> Breps, Closed
cap_holes_9 = CapHoles(Brep=brep_join_2.Breps)
rotate_direction_5 = RotateDirection(Geometry=flatten(join_curves_8), Center=area_3.Centroid, From=unit_y, To=unit_z)  # -> Geometry, Transform
sort_duplicate_curves_4 = SortDuplicateCurves(Curves=rotate_direction_4.Geometry)  # -> UniqueCurves, Indices
length_4 = Length(Curve=rotate_direction_4.Geometry)
merge_13 = Merge(Data1=rotate_direction_5.Geometry, Data2=rotate_direction_4.Geometry)  # -> flatten(Result)
panel_7 = Panel(length_4)
merge_14 = Merge(Data1=solid_union, Data2=solid_union_2)
project = Project(Geometry=merge_13, Plane=PlaneXY(0, 0, 0))  # -> Geometry, Transform
box_5 = Box(project.Geometry)
deconstruct_box_4 = DeconstructBox(Box=box_5)  # -> Plane, X, Y, Z
deconstruct_domain_6 = DeconstructDomain(Domain=deconstruct_box_4.Y)  # -> Start, End
deconstruct_domain_7 = DeconstructDomain(Domain=deconstruct_box_4.X)  # -> Start, End
vector_xyz_4 = VectorXYZ(XComponent=deconstruct_domain_7.Start, YComponent=deconstruct_domain_6.Start, ZComponent=0)  # -> Vector, Length
negative_9 = Negative(Value=vector_xyz_4.Vector)
move_7 = Move(Geometry=project.Geometry, Motion=negative_9)  # -> Geometry, Transform
sort_duplicate_curves_5 = SortDuplicateCurves(Curves=move_7.Geometry)  # -> UniqueCurves, Indices
box_6 = Box(sort_duplicate_curves_5.UniqueCurves)
deconstruct_box_5 = DeconstructBox(Box=box_6)  # -> Plane, X, Y, Z
deconstruct_domain_8 = DeconstructDomain(Domain=deconstruct_box_5.X)  # -> Start, End
deconstruct_domain_9 = DeconstructDomain(Domain=deconstruct_box_5.Y)  # -> Start, End
sort_list = SortList(Keys=deconstruct_domain_8.End, ValuesValuesA=deconstruct_domain_8.End)  # -> reverse(Keys), ValuesValuesA
sort_list_2 = SortList(Keys=deconstruct_domain_9.End, ValuesValuesA=deconstruct_domain_9.End)  # -> reverse(Keys), ValuesValuesA
list_item_6 = ListItem(List=sort_list.Keys, Index=0, Wrap=True)
list_item_7 = ListItem(List=sort_list_2.Keys, Index=0, Wrap=True)
expression_27 = Expression(s_x=expression_11, d_s=number_slider_9, d_e=list_item_6, Expression="(d_e-d_s)/(s_x*2)\1")
expression_28 = Expression(s_x=multiplication_2, d_s=number_slider_9, d_e=list_item_7, Expression="(d_e-d_s)/s_x\1")

expression_29 = Expression(wa=expression_16, n=expression_27, Expression="( n * (1.8 * wa - 0.8 ))\1")
concatenate = Concatenate(Fragment_A="Estimated global stiffness is ", Fragment_B=expression_29, A=" N/mm")
dk_p_text_2 = DKPText(Text=concatenate)

expression_30 = Expression(n_y=expression_28, y=number_slider_8, wb=expression_17, Expression="(n_y-1)*(y-wb)*100\1/100")
concatenate_2 = Concatenate(Fragment_A="Estimated range of Compression: ", Fragment_B=expression_30, A="mm")
dk_p_text_3 = DKPText(Text=concatenate_2)

expression_31 = Expression(x=dk_number_slider_5.Value, y=expression_29, Expression="x*y\1")
concatenate_3 = Concatenate(Fragment_A="Estimated Local Stiffness: ", Fragment_B=expression_31, A=" N/mm")

dk_p_text_4 = DKPText(Text=concatenate_3)
merge_15 = Merge(
    Data1=flatten(dk_h2_text_4),
    Data2=flatten(dk_number_slider_5.Slider),
    Data3=flatten(dk_p_text_4),
    Data4=flatten(dk_number_slider_4.Slider),
    Data5=flatten(dk_check_box_2.Check_box),
    Data6=flatten(dk_button_4.Button),
    Data7=flatten(dk_check_box.Check_box))

merge_16 = Merge(
    Data1=flatten(dk_h2_text_3),
    Data2=flatten([dk_number_slider.Slider, grid_phase_x_ui.Slider, grid_phase_y_ui.Slider, omit_edge_joints_ui.Check_box, edge_width_ratio_ui.Slider]),
    Data3=flatten(dk_number_slider_2.Slider),
    Data4=flatten(dk_p_text_2),
    Data5=flatten(dk_number_slider_3.Slider),
    Data6=flatten(dk_p_text_3),
    Data7=flatten(dk_button_5.Button))
stream_filter = StreamFilter(Gate=dk_tab_control_2.Value, Stream0=merge, Stream1=merge_16, Stream2=merge_15, Stream3=merge_2)
merge_17 = Merge(Data1=flatten(dk_tab_control_2.Tab_head), Data2=flatten(stream_filter))
dk_build_page = DKBuildPage(Css=dk_window_style_light, Html=merge_17)
dk_page_server = DKPageServer(Show=open_flexifab_ui, Page=dk_build_page)
subtraction = Subtraction(A=expression_27, B=1)
range = Range(Domain=construct_domain, Steps=subtraction)
subtraction_2 = Subtraction(A=expression_28, B=1)
addition_5 = Addition(A=range, B=expression_19)
range_2 = Range(Domain=construct_domain_2, Steps=subtraction_2)
addition_6 = Addition(A=range_2, B=graft(addition_5))
panel_8 = Panel(addition_5)
construct_point_7 = ConstructPoint(XCoordinate=0, YCoordinate=addition_6, ZCoordinate=0)
arc_2 = Arc(Plane=construct_point_7, Radius=expression_15, Angle=construct_domain_3)  # -> Arc, Length
curve_proximity = CurveProximity(CurveA=arc_2.Arc, CurveB=line_sdl)  # -> PointA, PointB, Distance
curve_closest_point = CurveClosestPoint(Point=curve_proximity.PointA, Curve=arc_2.Arc)  # -> Point, Parameter, Distance
shatter = Shatter(Curve=graft(arc_2.Arc), Parameters=graft(curve_closest_point.Parameter))
length_5 = Length(Curve=shatter)
list_item_8 = ListItem(List=shatter, Index=0, Wrap=True)  # -> Item, Item1
list_item_9 = ListItem(List=length_5, Index=0, Wrap=True)  # -> Item, Item1
expression_32 = Expression(x=list_item_9.Item, y=list_item_9.Item1, Expression="If(x<y, 0, 1)")
list_item_10 = ListItem(List=shatter, Index=expression_32, Wrap=True)
tangent_arcs = TangentArcs(CircleA=list_item_10, CircleB=move_2.Geometry, Radius=expression_18)  # -> ArcA, ArcB
end_points_3 = EndPoints(Curve=tangent_arcs.ArcA)  # -> Start, End
end_points_4 = EndPoints(Curve=tangent_arcs.ArcB)  # -> Start, End
curve_closest_point_2 = CurveClosestPoint(Point=end_points_3.Start, Curve=graft(arc_2.Arc))  # -> Point, Parameter, Distance
curve_closest_point_3 = CurveClosestPoint(Point=end_points_4.Start, Curve=graft(arc_2.Arc))  # -> Point, Parameter, Distance
curve_closest_point_4 = CurveClosestPoint(Point=end_points_3.End, Curve=move_2.Geometry)  # -> Point, Parameter, Distance
curve_closest_point_5 = CurveClosestPoint(Point=end_points_4.End, Curve=move_2.Geometry)  # -> Point, Parameter, Distance
merge_18 = Merge(Data1=curve_closest_point_2.Parameter, Data2=curve_closest_point_3.Parameter)
merge_19 = Merge(Data1=curve_closest_point_4.Parameter, Data2=curve_closest_point_5.Parameter)
shatter_2 = Shatter(Curve=graft(arc_2.Arc), Parameters=merge_18)
shatter_3 = Shatter(Curve=graft(move_2.Geometry), Parameters=merge_19)
list_item_11 = ListItem(List=shatter_2, Index=0, Wrap=True)  # -> Item, Item1, Item2
list_item_12 = ListItem(List=shatter_3, Index=0, Wrap=True)  # -> Item, Item1
trim_tree = TrimTree(Tree=list_item_12.Item, Depth=1)
simplify_tree = SimplifyTree(Tree=list_item_11.Item2, Front=False)
simplify_tree_2 = SimplifyTree(Tree=tangent_arcs.ArcB, Front=False)
simplify_tree_3 = SimplifyTree(Tree=list_item_12.Item, Front=False)
merge_20 = Merge(Data1=simplify_tree, Data2=simplify_tree_2, Data3=simplify_tree_3)
join_curves_9 = JoinCurves(Curves=merge_20, Preserve=False)
join_curves_10 = JoinCurves(Curves=flatten(merge_20), Preserve=False)
sort_duplicate_curves_6 = SortDuplicateCurves(Curves=sort_duplicate_curves_5.UniqueCurves)  # -> UniqueCurves, Indices
mirror_curve = MirrorCurve(Geometry=join_curves_9, Curve=line_sdl, Tangent=True)
join_curves_11 = JoinCurves(Curves=[join_curves_9, mirror_curve], Preserve=False)
end_points_5 = EndPoints(Curve=join_curves_11)  # -> Start, End
line_4 = Line(StartPoint=end_points_5.Start, EndPoint=end_points_5.End)
list_length = ListLength(List=sort_duplicate_curves_6.UniqueCurves)
duplicate_data_3 = DuplicateData(Data=multiplication_4, Number=expression_27, Order=True)
duplicate_data_4 = DuplicateData(Data=multiplication_2, Number=expression_28, Order=True)
mirror_curve_2 = MirrorCurve(Geometry=mirror_curve, Curve=line_4, Tangent=True)
mirror_curve_3 = MirrorCurve(Geometry=join_curves_11, Curve=line_4, Tangent=True)
expression_33 = Expression(x=list_length, Expression="(x^0.5)\1")
mass_addition_3 = MassAddition(Input=duplicate_data_3)  # -> Result, PartialResults
mass_addition_4 = MassAddition(Input=duplicate_data_4)  # -> Result, PartialResults
partition_list = PartitionList(List=sort_duplicate_curves_6.UniqueCurves, Size=expression_33)
join_curves_12 = JoinCurves(Curves=[join_curves_11, mirror_curve_3], Preserve=False)
move_8 = Move(Geometry=mirror_curve_2, Motion=vector_xyz_2.Vector)  # -> Geometry, Transform
expression_34 = Expression(y=dk_number_slider_5.Value, Expression="(y-1)*100")
merge_21 = Merge(Data1=number_slider_12, Data2=mass_addition_3.PartialResults)  # -> flatten(Result)
merge_22 = Merge(Data1=number_slider_12, Data2=mass_addition_4.PartialResults)  # -> flatten(Result)
move_9 = Move(Geometry=join_curves_12, Motion=vector_xyz_2.Vector)  # -> Geometry, Transform
group = Group(Objects=partition_list)
box_7 = Box(group)
area_5 = Area(Geometry=move_9.Geometry)  # -> Area, Centroid
move_10 = Move(Geometry=construct_point_7, Motion=vector_xyz_2.Vector)  # -> Geometry, Transform
deconstruct_box_6 = DeconstructBox(Box=box_7)  # -> Plane, X, Y, Z
unit_y_5 = UnitY(Factor=merge_22)
unit_x_8 = UnitX(Factor=merge_21)
list_item_13 = ListItem(List=flatten(join_curves_9), Index=0, Wrap=True)
list_item_14 = ListItem(List=flatten(move_8.Geometry), Index=0, Wrap=True)
list_item_15 = ListItem(List=flatten(join_curves_12), Index=expression_34, Wrap=True)
deconstruct_domain_10 = DeconstructDomain(Domain=deconstruct_box_6.Y)  # -> Start, End
deconstruct_domain_11 = DeconstructDomain(Domain=deconstruct_box_6.X)  # -> Start, End
list_item_16 = ListItem(List=flatten(move_9.Geometry), Index=expression_34, Wrap=True)
list_item_17 = ListItem(List=flatten(construct_point_7), Index=0, Wrap=True)
merge_23 = Merge(Data1=join_curves_12, Data2=move_9.Geometry)
list_item_18 = ListItem(List=flatten(area_5.Centroid), Index=0, Wrap=True)
list_item_19 = ListItem(List=flatten(move_10.Geometry), Index=0, Wrap=True)
addition_7 = Addition(A=graft(unit_x_8), B=unit_y_5)
group_2 = Group(Objects=merge_23)
list_item_20 = ListItem(List=flatten(group_2), Index=Slider(0, range=0..100), Wrap=True)
line_sdl_3 = LineSDL(Start=list_item_18, Direction=unit_x_5, Length=1)
construct_point_8 = ConstructPoint(XCoordinate=deconstruct_domain_11.Start, YCoordinate=deconstruct_domain_10.Start, ZCoordinate=0)
divide_curve = DivideCurve(Curve=list_item_14, Count=100, Kinks=False)  # -> graft(Points), Tangents, Parameters
divide_curve_2 = DivideCurve(Curve=list_item_13, Count=100, Kinks=False)  # -> Points, Tangents, Parameters
merge_24 = Merge(Data1=list_item_15, Data2=list_item_16)
move_11 = Move(Geometry=merge_24, Motion=graft(addition_4))  # -> Geometry, Transform
tree_statistics = TreeStatistics(Tree=addition_7)  # -> Paths, Length, Count
curve_curve_closest_point = CurveCurveClosestPoint(CurveA=list_item_13, CurveB=list_item_14)  # -> PointOnA, ParamOnA, PointOnB, ParamOnB
move_12 = Move(Geometry=group_2, Motion=graft(addition_7))  # -> Geometry, Transform
mirror_curve_4 = MirrorCurve(Geometry=list_item_19, Curve=line_sdl_3, Tangent=True)
panel_9 = Panel(addition_7)
z_preview = Geometry(entwine)
multiplication_5 = Multiplication(A=tree_statistics.Count, B=2)
vector_2pt_3 = Vector2Pt(PointA=construct_point_8, PointB=numbers_to_points, Unitize=False)  # -> Vector, Length
distance = Distance(PointA=curve_curve_closest_point.PointOnA, PointB=curve_curve_closest_point.PointOnB)
line_5 = Line(StartPoint=mirror_curve_4, EndPoint=list_item_17)
ungroup = Ungroup(Group=move_12.Geometry)
merge_25 = Merge(Data1=ungroup, Data2=grid)
merge_26 = Merge(Data1=flatten(move_11.Geometry), Data2=z_preview)
sort_list_3 = SortList(Keys=divide_curve_2.Parameters, ValuesValuesA=divide_curve_2.Parameters)  # -> reverse(Keys), ValuesValuesA
move_13 = Move(Geometry=partition_list, Motion=vector_2pt_3.Vector)  # -> Geometry, Transform
evaluate_curve = EvaluateCurve(Curve=list_item_13, Parameter=divide_curve_2.Parameters)  # -> Point, Tangent, Angle
merge_27 = Merge(Data1=list_item_13, Data2=list_item_14)
subtraction_3 = Subtraction(A=deconstruct_domain_11.End, B=deconstruct_domain_11.Start)
list_item_21 = ListItem(List=sort_list_3.Keys, Index=0, Wrap=True)
curve_closest_point_6 = CurveClosestPoint(Point=evaluate_curve.Point, Curve=list_item_14)  # -> Point, Parameter, Distance
area_6 = Area(Geometry=flatten(ungroup))  # -> Area, Centroid
curve_curve_closest_point_2 = CurveCurveClosestPoint(CurveA=line_5, CurveB=merge_27)  # -> PointOnA, ParamOnA, PointOnB, ParamOnB
merge_28 = Merge(Data1=0, Data2=subtraction_3)  # -> flatten(Result)
subtraction_4 = Subtraction(A=list_item_21, B=divide_curve_2.Parameters)
list_length_2 = ListLength(List=merge_28)
tree_statistics_2 = TreeStatistics(Tree=merge_26)  # -> Paths, Length, Count
line_6 = Line(StartPoint=evaluate_curve.Point, EndPoint=curve_closest_point_6.Point)
shatter_4 = Shatter(Curve=line_5, Parameters=[curve_curve_closest_point_2.ParamOnA, curve_curve_closest_point_2.ParamOnB])
expression_35 = Expression(x=list_length_2, Expression="x-2")
construct_domain_4 = ConstructDomain(DomainStart=0, DomainEnd=expression_35)
list_item_22 = ListItem(List=tree_statistics_2.Paths, Index=0, Wrap=True)  # -> Item, Item1, Item2
evaluate_curve_2 = EvaluateCurve(Curve=list_item_14, Parameter=subtraction_4)  # -> Point, Tangent, Angle
length_6 = Length(Curve=line_6)
list_item_23 = ListItem(List=shatter_4, Index=0, Wrap=True)  # -> Item, Item1
split_tree = SplitTree(Data=merge_26, Masks=flatten([list_item_22.Item1, list_item_22.Item2]))  # -> Positive, Negative
sub_list = SubList(List=merge_28, Domain=construct_domain_4, Wrap=True)  # -> List, Index
line_7 = Line(StartPoint=evaluate_curve.Point, EndPoint=evaluate_curve_2.Point)
sort_list_4 = SortList(Keys=length_6, ValuesValuesA=line_6)  # -> Keys, ValuesValuesA
mass_addition_5 = MassAddition(Input=flatten(sub_list.List))  # -> Result, graft(PartialResults)
geometry_9 = Geometry(list_item_23.Item1)
geometry_10 = Geometry(split_tree.Positive)
list_item_24 = ListItem(List=reverse(sort_list_4.ValuesValuesA), Index=0, Wrap=True)
length_7 = Length(Curve=line_7)
list_item_25 = ListItem(List=sort_list_4.ValuesValuesA, Index=0, Wrap=True)
group_3 = Group(Geometry=flatten(geometry_10))
length_8 = Length(Curve=geometry_9)
unit_x_9 = UnitX(Factor=mass_addition_5.PartialResults)
sort_list_5 = SortList(Keys=length_7, ValuesValuesA=line_7)  # -> Keys, ValuesValuesA
box_8 = Box(group_3)
move_14 = Move(Geometry=move_13.Geometry, Motion=unit_x_9)  # -> Geometry, Transform
list_item_26 = ListItem(List=reverse(sort_list_5.ValuesValuesA), Index=0, Wrap=True)
deconstruct_box_7 = DeconstructBox(Box=box_8)  # -> Plane, X, Y, Z
box_9 = Box(move_14.Geometry)
deconstruct_domain_12 = DeconstructDomain(Domain=deconstruct_box_7.Z)  # -> Start, End
deconstruct_box_8 = DeconstructBox(Box=box_9)  # -> Plane, X, Y, Z
duplicate_data_5 = DuplicateData(Data=Slider(0, range=0..100), Number=expression_33, Order=True)  # -> graft(Data)
expression_36 = Expression(
    s=deconstruct_domain_12.Start,
    e=deconstruct_domain_12.End,
    c=counter,
    t=Slider(38, range=0..100),
    Expression="(e-s)*2/3/t*(c%t)")
deconstruct_domain_13 = DeconstructDomain(Domain=deconstruct_box_8.Y)  # -> Start, End
construct_point_9 = ConstructPoint(XCoordinate=0, YCoordinate=deconstruct_domain_13.Start, ZCoordinate=0)
subtraction_5 = Subtraction(A=deconstruct_domain_13.End, B=deconstruct_domain_13.Start)
path_mapper = PathMapper(duplicate_data_5, source="{0;0;i}", target="{0;i}")
explode_tree = ExplodeTree(Data=geometry_10)  # -> Branch0, Branch1
mass_addition_6 = MassAddition(Input=subtraction_5)  # -> Result, PartialResults
vector_2pt_4 = Vector2Pt(PointA=construct_point_9, PointB=numbers_to_points, Unitize=False)  # -> Vector, Length
unit_z_4 = UnitZ(Factor=expression_36)
merge_29 = Merge(Data1=path_mapper, Data2=mass_addition_6.PartialResults)
list_length_3 = ListLength(List=merge_29)
move_15 = Move(Geometry=graft(move_14.Geometry), Motion=graft(vector_2pt_4.Vector))  # -> Geometry, Transform
negative_10 = Negative(Value=unit_z_4)
expression_37 = Expression(x=list_length_3, Expression="x-2")
move_16 = Move(Geometry=explode_tree.Branch0, Motion=unit_z_4)  # -> Geometry, Transform
construct_domain_5 = ConstructDomain(DomainStart=0, DomainEnd=expression_37)
move_17 = Move(Geometry=explode_tree.Branch1, Motion=negative_10)  # -> Geometry, Transform
merge_30 = Merge(Data1=move_16.Geometry, Data2=move_17.Geometry)
sub_list_2 = SubList(List=merge_29, Domain=construct_domain_5, Wrap=True)  # -> List, Index
unit_y_6 = UnitY(Factor=graft(sub_list_2.List))
panel_10 = Panel(move_15.Geometry)
entwine_2 = Entwine(Branch00=merge_30, Branch01=null, FlattenInputs=True)
move_18 = Move(Geometry=move_15.Geometry, Motion=unit_y_6)  # -> Geometry, Transform
tree_statistics_3 = TreeStatistics(Tree=entwine_2)  # -> Paths, Length, Count
group_4 = Group(Geometry=flatten(move_18.Geometry))
list_item_27 = ListItem(List=tree_statistics_3.Paths, Index=integer_2, Wrap=True)
geometry_11 = Geometry(graft(sort_duplicate_curves_5.UniqueCurves))
offset_curve = OffsetCurve(Curve=move_18.Geometry, Distance=negative_5, Corners=1)
boundary_surfaces_12 = BoundarySurfaces(Edges=geometry_11)
split_tree_2 = SplitTree(Data=entwine_2, Masks=flatten(list_item_27))  # -> Positive, Negative
prune_tree_2 = PruneTree(Tree=offset_curve, Minimum=1, Maximum=0)
explode_tree_2 = ExplodeTree(Data=geometry_11)  # -> Branch0, Branch1, Branch2, Branch3, Branch4, Branch5, Branch6, Branch7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
geometry_12 = Geometry(split_tree_2.Positive)
move_19 = Move(Geometry=area_6.Centroid, Motion=unit_x_6)  # -> Geometry, Transform
move_20 = Move(Geometry=area_6.Centroid, Motion=negative_6)  # -> Geometry, Transform
point_in_curve = PointInCurve(Point=area_6.Centroid, Curve=geometry_11)  # -> Relationship, Point
point_in_curve_2 = PointInCurve(Point=move_20.Geometry, Curve=geometry_11)  # -> Relationship, Point
point_in_curve_3 = PointInCurve(Point=move_19.Geometry, Curve=geometry_11)  # -> Relationship, Point
gate_or_2 = GateOr(A=point_in_curve.Relationship, B=point_in_curve_3.Relationship, C=point_in_curve_2.Relationship)
cull_pattern_3 = CullPattern(List=flatten(ungroup), CullPattern=gate_or_2)
explode_tree_3 = ExplodeTree(Data=cull_pattern_3)  # -> Branch0, Branch1, Branch2, Branch3, Branch4, Branch5, Branch6, Branch7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
region_difference_3 = RegionDifference(CurvesA=explode_tree_2.Branch2, CurvesB=explode_tree_3.Branch2)
geometry_13 = Geometry(explode_tree_2.Branch2)
boundary_surfaces_13 = BoundarySurfaces(Edges=explode_tree_3.Branch0)
ff_joint = Python3Script(
    Pattern=flatten(merge_24),
    Tunable=dk_check_box_2.Value,
    GridSpacing=dk_number_slider.Value,
    Dy=number_slider_8,
    ZLevel=dk_number_slider_4.Value,
    ThreadLength=threadlength,
    SmoothLength=smoothlength,
    Thickness=thickness,
    Clearance=clearance,
    Pitch=pitch,
    RootRadius=rootradius,
    CrestRadius=crestradius,
    Tolerance=tolerance,
    Model=flatten(geometry),
    TopMargin=topmargin_mm,
    RootMargin=rootmargin_mm,
    TopOnly=toponly,
    OpenBaseDepth=openbasedepth_mm,
    ShortThreadLength=shortthreadlength_mm,
    NeckLength=necklength_mm,
    GridPhaseX=grid_phase_x_ui.Value,
    GridPhaseY=grid_phase_y_ui.Value,
    RemoveNarrowEdges=omit_edge_joints_ui.Value,
    EdgeWidthRatio=edge_width_ratio_ui.Value,
    UnitPeriod=unitperiod_k_gridspacing_b)  # -> out, ProfilesA, ProfilesB, Assembly, Cut2D, Features, Report, GridPreview; inputs A: list of Curve, B: list of Curve, Pattern: list of Curve, Tunable: Boolean, GridSpacing: Double, Dy: Double, ZLevel: Double, ThreadLength: Double, SmoothLength: Double, Thickness: Double, Clearance: Double, Pitch: Double, RootRadius: Double, CrestRadius: Double, Tolerance: Double, Model: list of GeometryBase, TopMargin: Double, RootMargin: Double, TopOnly: Boolean, OpenBaseDepth: Double, ShortThreadLength: Double, NeckLength: Double, GridPhaseX: Double, GridPhaseY: Double, RemoveNarrowEdges: Boolean, EdgeWidthRatio: Double, UnitPeriod: Double
#   port ThreadLength: Extra tunable extension beyond SmoothLength. The B member has a full thread over ThreadLength + SmoothLength.
#   port SmoothLength: Smooth starter length retained when Tunable is False; included in the overall tunable B extension, which is fully threaded.
# ---------- ff_joint: Python ----------
#! python 3
# -*- coding: utf-8 -*-
# Rhino 8 CPython 3 Grasshopper component. Units: millimeters.
# A: XZ panel boundaries. B: YZ panel boundaries. Pattern: two staggered cutouts.
# Tunable=False removes the complete threaded length, retaining only SmoothLength.
import math
import Rhino.Geometry as rg
from Rhino.Geometry.Intersect import Intersection
from System import Array, Double
from System.Collections.Generic import IEnumerable


def unwrap(x):
    # Legacy GhPython can marshal serialized geometry inputs as virtual-document IDs.
    import System
    if isinstance(x,System.Guid):
        import rhinoscriptsyntax as rs
        geometry=rs.coercegeometry(x)
        if geometry is not None:return geometry
    if hasattr(x, 'ScriptVariable'):
        return x.ScriptVariable()
    return x


def seq(xs):
    if xs is None: return []
    try: return [unwrap(x) for x in xs]
    except TypeError: return [unwrap(xs)]


def number(x, default):
    x = unwrap(x)
    return default if x is None else float(x)


def boolean(x):
    x = unwrap(x)
    if isinstance(x, str): return x.strip().lower() in ('true', '1', 'yes')
    return bool(x)


def poly(points):
    curve=rg.Polyline()
    for x,y in points:curve.Add(float(x),float(y),0.0)
    return curve.ToPolylineCurve()


def rect(x0,y0,x1,y1):
    return poly([(x0,y0),(x1,y0),(x1,y1),(x0,y1),(x0,y0)])


def bounds(curves):
    b=rg.BoundingBox.Empty
    for c in curves: b.Union(c.GetBoundingBox(True))
    return b


def boolean_union(curves,tol):
    result=rg.Curve.CreateBooleanUnion(Array[rg.Curve](curves),tol)
    if result is None or len(result)==0:
        raise ValueError('Panel/tab union failed; check the panel bottom at this intersection.')
    return list(result)


def filter_difference(parts,outer,cutters,tol):
    # With coincident edges Rhino can occasionally return the cutout regions
    # instead of the remaining plate, even when the result is nonempty.
    faces=rg.Brep.CreatePlanarBreps(Array[rg.Curve](parts),tol)
    if not faces:return []
    kept=[]
    for face in faces:
        loops=[loop.To3dCurve() for loop in face.Loops]
        mass=rg.AreaMassProperties.Compute(face)
        p=mass.Centroid if mass and inside(mass.Centroid,loops,tol) else None
        if p is None:
            meshes=rg.Mesh.CreateFromBrep(face,rg.MeshingParameters.FastRenderMesh)
            for mesh in meshes or []:
                for i in range(mesh.Faces.Count):
                    q=mesh.Faces.GetFaceCenter(i)
                    if inside(q,loops,tol):p=q;break
                if p is not None:break
        if p is None:continue
        if not inside(p,[outer],tol):continue
        if any(c.Contains(p,rg.Plane.WorldXY,tol)!=rg.PointContainment.Outside for c in cutters):continue
        kept.append(face)
    if len(kept)==len(faces):return list(parts)
    return [loop.To3dCurve() for face in kept for loop in face.Loops]


def curve_difference(curve, cutters, tol):
    # Python.NET needs the multi-cutter overload selected explicitly.
    method = rg.Curve.CreateBooleanDifference.Overloads[rg.Curve, IEnumerable[rg.Curve], Double]
    return method(curve, Array[rg.Curve](cutters), float(tol))


def boolean_difference(curves, cutters, tol, witnesses=None, resolve_regions=False):
    if not cutters: return curves
    result=[]
    for curve in curves:
        parts=region_difference(curve,cutters,tol) if resolve_regions else curve_difference(curve,cutters,tol)
        if parts is not None and len(parts)>0:
            parts=filter_difference(parts,curve,cutters,tol)
        expected=[p for p in (witnesses or []) if inside(p,[curve],tol) and not any(c.Contains(p,rg.Plane.WorldXY,tol)!=rg.PointContainment.Outside for c in cutters)]
        if parts is None or len(parts)==0 or any(not inside(p,parts,tol) for p in expected):
            parts=region_difference(curve,cutters,tol)
        if any(not inside(p,parts,tol) for p in expected):raise ValueError('The cutting operation lost a protected joint region.')
        result.extend(list(parts))
    if not result: raise ValueError('Joint slot removed the entire panel.')
    return result


def inside(p,loops,tol):
    return sum(c.Contains(p,rg.Plane.WorldXY,tol)==rg.PointContainment.Inside for c in loops)%2==1


def region_difference(outer,cutters,tol):
    # Rhino's multi-cutter difference can return an empty array around coincident
    # trim vertices. Rebuild the same material regions explicitly in that case.
    curves=Array[rg.Curve]([outer]+list(cutters))
    cells=rg.Curve.CreateBooleanRegions(curves,rg.Plane.WorldXY,False,tol)
    if cells is None:raise ValueError('Cannot resolve the panel cutting regions.')
    seeds=[]
    for i in range(cells.RegionCount):
        loops=list(cells.RegionCurves(i));sample=None
        faces=rg.Brep.CreatePlanarBreps(Array[rg.Curve](loops),tol)
        if not faces:continue
        for face in faces:
            meshes=rg.Mesh.CreateFromBrep(face,rg.MeshingParameters.FastRenderMesh)
            if not meshes:continue
            for mesh in meshes:
                for fi in range(mesh.Faces.Count):
                    p=mesh.Faces.GetFaceCenter(fi)
                    if inside(p,loops,tol):sample=p;break
                if sample is not None:break
            if sample is not None:break
        if sample is not None and inside(sample,[outer],tol) and not any(
                c.Contains(sample,rg.Plane.WorldXY,tol)!=rg.PointContainment.Outside for c in cutters):
            seeds.append(sample)
    if not seeds:return []
    regions=rg.Curve.CreateBooleanRegions(curves,rg.Plane.WorldXY,Array[rg.Point3d](seeds),True,tol)
    if regions is None:raise ValueError('Cannot join the retained panel regions.')
    result=[]
    for i in range(regions.RegionCount):result.extend(list(regions.RegionCurves(i)))
    return result


def intervals(loops,u,tol):
    b=bounds(loops);line=rg.Line(rg.Point3d(u,b.Min.Y-100,0),rg.Point3d(u,b.Max.Y+100,0))
    ys=[]
    for c in loops:
        events=Intersection.CurveLine(c,line,tol,tol)
        if events:
            for e in events:
                if e.IsPoint: ys.append(e.PointA.Y)
                elif e.IsOverlap:
                    ys.extend([c.PointAt(e.OverlapA.T0).Y,c.PointAt(e.OverlapA.T1).Y])
    ys.sort();clean=[]
    for y in ys:
        if not clean or y-clean[-1]>tol: clean.append(y)
    return [(a,b) for a,b in zip(clean[:-1],clean[1:]) if b-a>tol and inside(rg.Point3d(u,(a+b)/2,0),loops,tol)]


def panels(values,kind,tol):
    groups={}
    for c in seq(values):
        if not isinstance(c,rg.Curve) or not c.IsClosed:
            raise ValueError('A/B require closed section curves, before lap-slot subtraction.')
        b=c.GetBoundingBox(True)
        fixed=(b.Min.Y+b.Max.Y)/2 if kind=='A' else (b.Min.X+b.Max.X)/2
        deviation=b.Max.Y-b.Min.Y if kind=='A' else b.Max.X-b.Min.X
        if deviation>tol*2: raise ValueError('A must be in XZ planes and B in YZ planes.')
        key=int(round(fixed/tol))
        if key not in groups:
            plane=rg.Plane(rg.Point3d(0,fixed,0),rg.Vector3d.XAxis,rg.Vector3d.ZAxis) if kind=='A' else rg.Plane(rg.Point3d(fixed,0,0),rg.Vector3d.YAxis,rg.Vector3d.ZAxis)
            groups[key]={'fixed':fixed,'plane':plane,'loops':[],'joints':[],'kind':kind}
        q=c.DuplicateCurve();q.Transform(rg.Transform.PlaneToPlane(groups[key]['plane'],rg.Plane.WorldXY))
        # Raw slicing occasionally returns the same closed section more than once.
        if not any(rg.GeometryBase.GeometryEquals(q,p) for p in groups[key]['loops']):groups[key]['loops'].append(q)
    return [groups[k] for k in sorted(groups)]


def thread_radius(depth,phase,pitch,root,crest):
    t=(depth/pitch+phase)%1.0
    ramp=(crest-root)/math.sqrt(3.0)/pitch
    flat=1.0-2.0*ramp
    if flat<0: raise ValueError('Thread depth is too large for the 60-degree pitch.')
    if t<ramp: return root+(crest-root)*t/ramp
    if t<ramp+flat: return crest
    return root+(crest-root)*(1-t)/ramp


def attachment_top(loops,u,base,half_width,overlap,tol):
    # A curved bottom rises across the stud width. The center-line contact
    # height is therefore insufficient, particularly near either end of a panel.
    spans=[(base,bounds(loops).Max.Y)]
    for i in range(17):
        x=u-half_width+2*half_width*i/16.0
        vertical=intervals(loops,x,tol)
        spans=[(max(a,c),min(b,d)) for a,b in spans for c,d in vertical
               if min(b,d)-max(a,c)>overlap+4*tol]
        if not spans:break
    for low,high in sorted(spans):
        y=max(base+0.5,low+overlap+2*tol)
        # Validate the whole collar against the actual curves, not just samples.
        # This also catches a concave boundary dipping between sampled columns.
        while y<high-2*tol:
            collar=rect(u-half_width,y-overlap,u+half_width,y)
            mid=rg.Point3d(u,y-overlap/2,0)
            if inside(mid,loops,tol):
                crossings=any(Intersection.CurveCurve(collar,c,tol,tol).Count>0 for c in loops)
                enclosed_boundary=any(collar.Contains(c.PointAtStart,rg.Plane.WorldXY,tol)==rg.PointContainment.Inside for c in loops)
                if not crossings and not enclosed_boundary:return y
            y+=max(overlap/2,10*tol)
    raise ValueError('A joint is too close to the panel boundary to attach its full neck width. Move this intersection inward or reduce the root radius.')


def side_points(u,root_y,side,phase,length,smooth,pitch,root,crest,tunable,neck_top=None):
    top=root_y+0.5 if neck_top is None else neck_top
    points=[(u+side*root,top),(u+side*root,root_y)]
    if tunable and length>0:
        ramp=(crest-root)/math.sqrt(3.0)/pitch
        depths=[0.0,length]
        for k in range(-2,int(math.ceil(length/pitch))+3):
            for f in [0.0,ramp,1.0-ramp]:
                d=(k+f-phase)*pitch
                if 0<d<length:depths.append(d)
        for d in sorted(set(depths)):
            points.append((u+side*thread_radius(d,phase,pitch,root,crest),root_y-d))
        points.append((u+side*root,root_y-length))
    else:length=0.0
    # Smooth starter and a small chamfer remain in both modes.
    chamfer=min(0.5,smooth/3)
    points.extend([(u+side*root,root_y-length-smooth+chamfer),(u+side*(root-chamfer),root_y-length-smooth)])
    return points


def tab(u,y,phase,length,smooth,pitch,root,crest,tunable,neck_top=None):
    left=side_points(u,y,-1,phase+0.5,length,smooth,pitch,root,crest,tunable,neck_top)
    right=side_points(u,y,1,phase,length,smooth,pitch,root,crest,tunable,neck_top)
    pts=left+list(reversed(right));pts.append(pts[0])
    clean=[pts[0]]
    for p in pts[1:]:
        if abs(p[0]-clean[-1][0])+abs(p[1]-clean[-1][1])>1e-10:clean.append(p)
    return poly(clean)


def short_head_tab(u, bottom, phase, total, neck, head, pitch, root, crest, neck_top, x0, x1, relief, tol):
    # The standard tunable pair has a smooth neck and a short terminal thread.
    # Its tip aligns with the long slotted member. The recessed shoulder and
    # side reliefs leave space for nut travel, with outer feet where a bay fits.
    tip=bottom-total
    shoulder=tip+neck+head
    start=tip+head
    thread_phase=(phase+(total-head)/pitch)%1.0
    left=side_points(u,start,-1,thread_phase+0.5,head,0.0,pitch,root,crest,True,shoulder)
    right=side_points(u,start,1,thread_phase,head,0.0,pitch,root,crest,True,shoulder)
    points=[(x0,bottom),(u-root,bottom),(u-root,neck_top),(u+root,neck_top),(u+root,bottom),(x1,bottom)]
    if x1>u+relief+tol:
        points.extend([(x1,tip),(u+relief,tip),(u+relief,shoulder)])
    else:points.append((x1,shoulder))
    points.extend(right)
    points.extend(reversed(left))
    if x0<u-relief-tol:
        points.extend([(u-relief,shoulder),(u-relief,tip),(x0,tip)])
    else:points.append((x0,shoulder))
    points.append((x0,bottom))
    # Remove duplicate vertices where a thread starts/ends exactly at a root.
    clean=[]
    for p in points:
        if not clean or abs(p[0]-clean[-1][0])>tol/100 or abs(p[1]-clean[-1][1])>tol/100:clean.append(p)
    return poly(clean)


def pattern_holes(outers,templates,spacing,row_step,tol,origin_x=0.0,row_offset=0.0):
    # One lattice for the whole model. The upstream GH construction already
    # couples dx=UnitPeriod-1 and the stagger=UnitPeriod/2. Copy those exact
    # curves by translation; neither slot width nor bay width changes a unit.
    if not templates:return []
    tb=bounds(templates);first=templates[0].GetBoundingBox(True)
    dx=origin_x-(first.Min.X+first.Max.X)/2
    dy=row_offset-tb.Min.Y
    b=bounds(outers);holes=[]
    xmin=int(math.floor((b.Min.X-tb.Max.X-dx)/spacing))
    xmax=int(math.ceil((b.Max.X-tb.Min.X-dx)/spacing))
    ymin=int(math.floor((b.Min.Y-tb.Max.Y-dy)/row_step))
    ymax=int(math.ceil((b.Max.Y-tb.Min.Y-dy)/row_step))
    if (xmax-xmin+1)*(ymax-ymin+1)*len(templates)>15000:
        raise ValueError('Too many lattice units; increase Grid Spacing.')
    for ix in range(xmin,xmax+1):
        for iy in range(ymin,ymax+1):
            for c in templates:
                q=c.DuplicateCurve()
                q.Transform(rg.Transform.Translation(dx+ix*spacing,dy+iy*row_step,0))
                qb=q.GetBoundingBox(True)
                if qb.Min.Y>b.Min.Y+tol and qb.Max.Y<b.Max.Y+row_step and qb.Max.X>b.Min.X and qb.Min.X<b.Max.X:
                    holes.append(q)
    return holes


def below_top_margin(hole,loops,margin,tol):
    # Suppress complete openings, as in the paper's upper-boundary rule.
    # Translating the opening up by the requested margin must keep it inside
    # the original section. This follows a curved roof rather than its bbox.
    shifted=hole.DuplicateCurve()
    shifted.Transform(rg.Transform.Translation(0,margin,0))
    if not inside(shifted.PointAtStart,loops,tol):return False
    return not any(Intersection.CurveCurve(shifted,c,tol,tol).Count>0 for c in loops)


def top_margin_holes(holes,loops,margin,top_only,tol):
    if not top_only:
        return [h for h in holes if below_top_margin(h,loops,margin,tol)]
    # Protect only the horizontal band below this panel's highest point.
    # Elsewhere, let the final panel difference trim openings at the roof edge.
    # Keep complete tangent units at the band's lower edge, avoiding flat cuts
    # into the arcs. Consequently the measured cap can exceed the requested size.
    ceiling=bounds(loops).Max.Y-margin
    return [h for h in holes if h.GetBoundingBox(True).Max.Y<=ceiling+tol]


def root_margin_holes(holes,loops,margin,tol):
    # A full-width horizontal blank band above the raw panel's lowest point.
    # Joint collars are protected separately; the band also covers both ends
    # and the regions between joints. Suppress whole units, preserving arcs.
    if margin<=0:return holes
    floor=bounds(loops).Min.Y+margin
    return [h for h in holes if h.GetBoundingBox(True).Min.Y>=floor-tol]


def clear_of_root_margin(hole,protection,tol):
    # Suppress the whole boundary unit instead of clipping a flat into an arc.
    for region in protection:
        if Intersection.CurveCurve(hole,region,tol,tol).Count>0:return False
        if region.Contains(hole.PointAtStart,rg.Plane.WorldXY,tol)!=rg.PointContainment.Outside:return False
        if hole.Contains(region.PointAtStart,rg.Plane.WorldXY,tol)!=rg.PointContainment.Outside:return False
    return True


def actual_slot_end_segments(ends,outers,tol):
    actual=[]
    for end in ends:
        parameters=[end.Domain.T0,end.Domain.T1]
        for outer in outers:
            events=Intersection.CurveCurve(end,outer,tol,tol)
            for e in events or []:
                if e.IsPoint:parameters.append(e.ParameterA)
                elif e.IsOverlap:parameters.extend([e.OverlapA.T0,e.OverlapA.T1])
        parameters=sorted(set(parameters))
        for a,b in zip(parameters,parameters[1:]):
            if b-a<1e-10:continue
            p=end.PointAt((a+b)/2)
            if any(o.Contains(p,rg.Plane.WorldXY,tol)!=rg.PointContainment.Outside for o in outers):
                segment=end.Trim(a,b)
                if segment is not None:actual.append(segment)
    return actual


def touches_slot_end(hole,ends,tol):
    for end in ends:
        if Intersection.CurveCurve(hole,end,tol,tol).Count>0:return True
        for f in [0.0,0.5,1.0]:
            p=end.PointAt(end.Domain.ParameterAt(f))
            if hole.Contains(p,rg.Plane.WorldXY,tol)!=rg.PointContainment.Outside:return True
    return False


def isolate_slot_end_cutouts(holes,ends,outers,tol):
    # Only the finite closed end is protected. Lattice openings along the long
    # slot walls remain allowed; do not turn a slot into a full-height keepout.
    actual=actual_slot_end_segments(ends,outers,tol)
    kept=[h for h in holes if not touches_slot_end(h,actual,tol)]
    return kept,actual


def material_regions(curves,tol):
    faces=rg.Brep.CreatePlanarBreps(Array[rg.Curve](curves),tol)
    return [([loop.To3dCurve() for loop in face.Loops],face) for face in faces or []]


def same_material_components(curves,original,tol):
    regions=material_regions(curves,tol)
    if not regions or len(regions)!=len(original):return False
    if len(original)==1:return True
    # Multiple source silhouettes may legitimately be separate. Preserve each
    # one rather than allowing one deleted body to hide a newly split body.
    counts=[0]*len(original)
    for loops,face in regions:
        mass=rg.AreaMassProperties.Compute(face)
        sample=mass.Centroid if mass and inside(mass.Centroid,loops,tol) else None
        if sample is None:
            for mesh in rg.Mesh.CreateFromBrep(face,rg.MeshingParameters.FastRenderMesh) or []:
                for i in range(mesh.Faces.Count):
                    point=mesh.Faces.GetFaceCenter(i)
                    if inside(point,loops,tol):sample=point;break
                if sample is not None:break
        if sample is None:return False
        matches=[i for i,(source,unused) in enumerate(original) if inside(sample,source,tol)]
        if len(matches)!=1:return False
        counts[matches[0]]+=1
    return all(n==1 for n in counts)


def boxes_meet(a,b,tol):
    return not (a.Max.X<b.Min.X-tol or b.Max.X<a.Min.X-tol or
                a.Max.Y<b.Min.Y-tol or b.Max.Y<a.Min.Y-tol)


def touches_material_boundary(hole,regions,tol):
    hb=hole.GetBoundingBox(True)
    for loops,unused in regions:
        for boundary in loops:
            if not boxes_meet(hb,boundary.GetBoundingBox(True),tol):continue
            if Intersection.CurveCurve(hole,boundary,tol,tol).Count:return True
            if hole.Contains(boundary.PointAtStart,rg.Plane.WorldXY,tol)!=rg.PointContainment.Outside:return True
    return False


def cutouts_overlap(a,b,tol):
    if not boxes_meet(a.GetBoundingBox(True),b.GetBoundingBox(True),tol):return False
    return (Intersection.CurveCurve(a,b,tol,tol).Count>0 or
            a.Contains(b.PointAtStart,rg.Plane.WorldXY,tol)!=rg.PointContainment.Outside or
            b.Contains(a.PointAtStart,rg.Plane.WorldXY,tol)!=rg.PointContainment.Outside)


def suppress_fragmenting_cutouts(outers,slots,holes,tol,witnesses,resolve_regions):
    # Slot geometry stays intact. Only omit entire original lattice cutouts
    # when subtracting them would create separate material pieces.
    base=boolean_difference(outers,slots,tol,witnesses,resolve_regions)
    original=material_regions(base,tol)
    if not original:raise ValueError('The structural panel has no material region.')
    if not holes:return [],0,base
    def cut(selected):return boolean_difference(outers,slots+selected,tol,witnesses,resolve_regions)
    try:
        full=cut(holes)
        if same_material_components(full,original,tol):return holes,0,full
    except ValueError:pass
    # A disjoint interior hole cannot disconnect a sheet. Most cells therefore
    # need no trial. Test boundary cells against the original slotted sheet;
    # every independently spanning cell is suppressed, not merely the last
    # one in a chain of detached edge fingers.
    boundary=[touches_material_boundary(h,original,tol) for h in holes]
    kept=[]
    for h,at_boundary in zip(holes,boundary):
        if at_boundary:
            try:
                if not same_material_components(cut([h]),original,tol):continue
            except ValueError:continue
        kept.append(h)
    try:
        result=cut(kept)
        if same_material_components(result,original,tol):return kept,len(holes)-len(kept),result
    except ValueError:pass
    # Intersecting cutouts can form a passage together even when neither
    # splits the blank alone. Keep isolated interior holes in bulk, then
    # admit the remaining whole cells only while connectivity is preserved.
    special=[touches_material_boundary(h,original,tol) for h in kept]
    for i,a in enumerate(kept):
        for j in range(i+1,len(kept)):
            if cutouts_overlap(a,kept[j],tol):special[i]=True;special[j]=True
    safe=[h for h,flag in zip(kept,special) if not flag]
    try:
        result=cut(safe)
        if not same_material_components(result,original,tol):safe=[];result=base
    except ValueError:safe=[];result=base
    accepted=list(safe)
    safe_ids=set(id(h) for h in safe)
    for h in kept:
        if id(h) in safe_ids:continue
        try:
            trial=cut(accepted+[h])
            if same_material_components(trial,original,tol):accepted.append(h);result=trial
        except ValueError:pass
    accepted_ids=set(id(h) for h in accepted)
    accepted=[h for h in holes if id(h) in accepted_ids]
    return accepted,len(holes)-len(accepted),result


def connection_state(curves,witnesses,tol,outers):
    faces=rg.Brep.CreatePlanarBreps(Array[rg.Curve](curves),tol)
    if not faces:return list(witnesses),True
    regions=[([loop.To3dCurve() for loop in f.Loops],rg.AreaMassProperties.Compute(f).Area) for f in faces]
    missing=[];split=False
    # Distinct original silhouettes may legitimately form separate bodies.
    # Check each joint against its own original silhouette's main region.
    for outer in outers:
        points=[p for p in witnesses if inside(p,[outer],tol)]
        if not points:continue
        candidates=[(loops,area) for loops,area in regions if outer.Contains(loops[0].PointAtStart,rg.Plane.WorldXY,tol)!=rg.PointContainment.Outside]
        if not candidates:missing.extend(points);continue
        if len(candidates)>1:split=True
        loops=max(candidates,key=lambda item:item[1])[0]
        missing.extend(p for p in points if not inside(p,loops,tol))
    return missing,split


def remove_boundary_chips(curves,minimum_area,tol,witnesses=None,outline=None):
    # Fitting an open end cell to a curved outline can leave tiny loose chips.
    # Remove only isolated regions, never holes or a ligament in the main body.
    regions=rg.Brep.CreatePlanarBreps(Array[rg.Curve](curves),tol)
    if not regions:return curves,0
    areas=[rg.AreaMassProperties.Compute(s).Area for s in regions]
    threshold=min(minimum_area,max(areas)/1000.0)
    kept=[]
    edge_limit=min(4*minimum_area,max(areas)/100.0)
    for s,a in zip(regions,areas):
        loops=[loop.To3dCurve() for loop in s.Loops]
        protected=any(inside(p,loops,tol) for p in (witnesses or []))
        if a<threshold and not protected:continue
        # Partial roof-edge units can leave larger loose corner offcuts. Only
        # discard small boundary pieces that contain no protected stud region.
        at_edge=outline and any(Intersection.CurveCurve(c,o,tol,tol).Count>0 for c in loops for o in outline)
        if not protected and a<edge_limit and at_edge:continue
        kept.append(s)
    removed=len(regions)-len(kept)
    if not removed:return curves,0
    return [loop.To3dCurve() for s in kept for loop in s.Loops],removed


def close_roof_section(curve,plane,base,tol):
    # An open roof has no material region to slice. Close its section down to
    # the common horizontal base, retaining the roof curve exactly.
    local=curve.DuplicateCurve()
    local.Transform(rg.Transform.PlaneToPlane(plane,rg.Plane.WorldXY))
    b=local.GetBoundingBox(True)
    if b.Max.X-b.Min.X<=tol:
        raise ValueError('Open Model must be a roof surface over XY, not a vertical sheet.')
    if b.Min.Y<base-2*tol:
        raise ValueError('Open surface extends below its base plane.')
    # Refuse overhangs rather than inventing an ambiguous filled silhouette.
    for i in range(1,34):
        x=b.Min.X+(b.Max.X-b.Min.X)*i/34.0
        line=rg.Line(rg.Point3d(x,b.Min.Y-1,0),rg.Point3d(x,b.Max.Y+1,0))
        events=Intersection.CurveLine(local,line,tol,tol)
        heights=[]
        for e in events or []:
            if e.IsOverlap:raise ValueError('Open Model has a vertical or folded section; use a single-valued roof surface.')
            if e.IsPoint and not any(abs(e.PointA.Y-y)<2*tol for y in heights):heights.append(e.PointA.Y)
        if len(heights)>1:
            raise ValueError('Open Model has an overhang; use a roof surface with one height at each XY position.')
    start=local.PointAtStart;end=local.PointAtEnd
    if abs(end.X-start.X)<=tol:
        raise ValueError('Open roof section does not span the base plane.')
    result=rg.PolyCurve();result.Append(local)
    points=[end,rg.Point3d(end.X,base,0),rg.Point3d(start.X,base,0),start]
    for a,b in zip(points[:-1],points[1:]):
        if a.DistanceTo(b)>tol:result.Append(rg.LineCurve(a,b))
    result.MakeClosed(2*tol)
    faces=rg.Brep.CreatePlanarBreps(result,tol)
    if not result.IsClosed or not result.IsValid or not faces or sum(rg.AreaMassProperties.Compute(f).Area for f in faces)<=tol*tol:
        raise ValueError('Open roof section has no usable height; increase OpenBaseDepth.')
    result.Transform(rg.Transform.PlaneToPlane(rg.Plane.WorldXY,plane))
    return result


def section_grid(low,high,spacing,phase,edge_clearance,tol):
    # Count and spacing do not depend on phase. Translate the centered finite
    # grid within the remaining room, keeping a full joint neck at each edge.
    size=high-low
    n=max(1,int(math.floor(size/spacing)))
    travel=max(0.0,(size-(n-1)*spacing)/2.0-edge_clearance)
    shift=phase*travel
    positions=[low+size/2+(i-(n-1)/2.0)*spacing+shift for i in range(n)]
    return positions,shift,travel


def slice_model(values,spacing,tol,base_depth=0.0,phase_x=0.0,phase_y=0.0,edge_clearance=0.0,grid_info=None):
    breps=[]
    for geo in seq(values):
        if isinstance(geo,rg.Mesh):
            geo=rg.Brep.CreateFromMesh(geo,True)
        elif isinstance(geo,rg.Surface):geo=geo.ToBrep()
        if not isinstance(geo,rg.Brep) or not geo.IsValid:
            raise ValueError('Model must contain valid Breps, surfaces or meshes.')
        breps.append(geo)
    box=rg.BoundingBox.Empty
    for geo in breps:box.Union(geo.GetBoundingBox(True))
    base=box.Min.Z-base_depth
    aa=[];bb=[]
    for kind,low,high,phase in [('A',box.Min.Y,box.Max.Y,phase_y),('B',box.Min.X,box.Max.X,phase_x)]:
        positions,shift,travel=section_grid(low,high,spacing,phase,edge_clearance,tol)
        if grid_info is not None:grid_info[kind]={'count':len(positions),'shift':shift,'travel':travel}
        for fixed in positions:
            before=len(aa if kind=='A' else bb)
            plane=rg.Plane(rg.Point3d(0,fixed,0),rg.Vector3d.XAxis,rg.Vector3d.ZAxis) if kind=='A' else rg.Plane(rg.Point3d(fixed,0,0),rg.Vector3d.YAxis,rg.Vector3d.ZAxis)
            open_spans=[]
            for geo in breps:
                hit,curves,points=Intersection.BrepPlane(geo,plane,tol)
                if hit and curves:
                    joined=rg.Curve.JoinCurves(curves,tol)
                    for c in joined:
                        if c.IsClosed:
                            (aa if kind=='A' else bb).append(c)
                        elif not geo.IsSolid:
                            closed=close_roof_section(c,plane,base,tol)
                            cb=closed.GetBoundingBox(True)
                            lo,hi=(cb.Min.X,cb.Max.X) if kind=='A' else (cb.Min.Y,cb.Max.Y)
                            if any(min(hi,d)-max(lo,a)>2*tol for a,d in open_spans):
                                raise ValueError('Open roof sections overlap vertically; join adjacent surfaces or use a single roof layer.')
                            open_spans.append((lo,hi))
                            (aa if kind=='A' else bb).append(closed)
            if phase and len(aa if kind=='A' else bb)==before:
                axis='Y' if kind=='A' else 'X'
                raise ValueError('GridPhase%s places a section outside the usable model footprint. Reduce its magnitude.'%axis)
    return aa,bb


def phase_sections(model,spacing,tol,base_depth,phase_x,phase_y,edge_clearance,root,embed,level,open_roof):
    # A bounding box alone does not describe a curved footprint. If the
    # requested translation cannot hold the fixed grid and its full joints,
    # limit the translation along the same direction toward the valid center.
    if not phase_x and not phase_y:
        info={}
        a,b=slice_model(model,spacing,tol,base_depth,0.0,0.0,edge_clearance,info)
        return a,b,info,1.0
    base_a,base_b=slice_model(model,spacing,tol,base_depth)
    required=(len(panels(base_a,'A',tol)),len(panels(base_b,'B',tol)))
    def trial(scale):
        info={}
        a,b=slice_model(model,spacing,tol,base_depth,phase_x*scale,phase_y*scale,edge_clearance,info)
        aa=panels(a,'A',tol);bb=panels(b,'B',tol)
        if (len(aa),len(bb))!=required:
            raise ValueError('The section grid leaves the model footprint.')
        if not open_roof:
            for pa in aa:
                for pb in bb:
                    for lo,hi in intervals(pa['loops'],pb['fixed'],tol):
                        for lo2,hi2 in intervals(pb['loops'],pa['fixed'],tol):
                            bottom=max(lo,lo2);top=min(hi,hi2)
                            if top-bottom<=max(2.0,level):continue
                            attachment_top(pa['loops'],pb['fixed'],bottom,root,embed,tol)
                            attachment_top(pb['loops'],pa['fixed'],bottom,root,embed,tol)
        return a,b,info,scale
    try:return trial(1.0)
    except ValueError:pass
    best=trial(0.0);low=0.0;high=1.0
    for unused in range(10):
        middle=(low+high)/2.0
        try:
            candidate=trial(middle);best=candidate;low=middle
        except ValueError:high=middle
    return best


def section_grid_preview(panels,thickness,tol):
    result=[]
    for panel in panels:
        transform=rg.Transform.PlaneToPlane(rg.Plane.WorldXY,panel['plane'])
        curves=[]
        for loop in panel['loops']:
            q=loop.DuplicateCurve();q.Transform(transform);curves.append(q)
        faces=rg.Brep.CreatePlanarBreps(Array[rg.Curve](curves),tol)
        if not faces:raise ValueError('Cannot preview a section-grid panel.')
        normal=panel['plane'].Normal
        for face in faces:
            face.Transform(rg.Transform.Translation(normal*(-thickness/2)))
            path=rg.LineCurve(rg.Point3d.Origin,rg.Point3d(normal*thickness))
            solid=face.Faces[0].CreateExtrusion(path,True)
            if solid is None or not solid.IsValid or not solid.IsSolid:
                raise ValueError('Section-grid preview is not a valid closed solid.')
            if solid.SolidOrientation==rg.BrepSolidOrientation.Inward:solid.Flip()
            result.append(solid)
    return result


def narrow_edge_joints(panel,unit_width,ratio,half_slot):
    # Select the original edge joints once. Keep the entire source outline:
    # omitted joints have no slot, tab, neck protection or slot-end keepout,
    # so the unchanged periodic lattice continues across their former axes.
    axes=sorted(set(j[0] for j in panel['joints']))
    if not axes:return []
    box=bounds(panel['loops']);threshold=unit_width*ratio
    left=axes[0]-half_slot-box.Min.X
    right=box.Max.X-axes[-1]-half_slot
    drop_left=left<threshold;drop_right=right<threshold
    removed=set();result=[]
    if drop_left:
        removed.add(axes[0])
        result.append(('left',left,axes[0]))
    if drop_right:
        removed.add(axes[-1])
        result.append(('right',right,axes[-1]))
    panel['removed_axes']=removed
    return result


def generate(A,B,Pattern,Tunable,GridSpacing,Dy,ZLevel,ThreadLength,SmoothLength,Thickness,Clearance,Pitch,RootRadius,CrestRadius,Tolerance,Model=None,TopMargin=None,RootMargin=None,TopOnly=None,OpenBaseDepth=None,ShortThreadLength=None,NeckLength=None,GridPhaseX=None,GridPhaseY=None,RemoveNarrowEdges=None,EdgeWidthRatio=None,UnitPeriod=None):
    tol=number(Tolerance,0.01);gs=number(GridSpacing,24);dy=number(Dy,4.5)
    period=number(UnitPeriod,gs)
    if math.isnan(period) or math.isinf(period) or period<=1.0+tol:
        raise ValueError('UnitPeriod must be greater than 1 mm. Increase UnitPeriodFactor or UnitPeriodOffset.')
    t=number(Thickness,3.175);gap=number(Clearance,0.025);pitch=number(Pitch,1.75)
    length=number(ThreadLength,26.5);smooth=number(SmoothLength,3.5)
    rr=number(RootRadius,4.6);rc=number(CrestRadius,5.7211);level=number(ZLevel,5)
    top_margin=number(TopMargin,6.0);root_margin=number(RootMargin,12.0)
    top_only=True if TopOnly is None else boolean(TopOnly)
    base_depth=number(OpenBaseDepth,0.0)
    if base_depth<0:raise ValueError('OpenBaseDepth must be nonnegative.')
    if min(top_margin,root_margin)<0:raise ValueError('TopMargin and RootMargin must be nonnegative.')
    tune=boolean(Tunable)
    head_length=number(ShortThreadLength,3.5);neck_length=number(NeckLength,10.0)
    if head_length<=0 or neck_length<0:raise ValueError('ShortThreadLength must be positive and NeckLength nonnegative.')
    total=length+smooth if tune else smooth
    if tune and head_length+neck_length>total+tol:
        raise ValueError('ThreadLength + SmoothLength must be at least NeckLength + ShortThreadLength for the aligned standard joint.')
    if min(tol,gs,dy,t,pitch,smooth,rr,level)<=0 or gap<0 or length<0 or rc<=rr:
        raise ValueError('Lengths must be positive; clearance/thread length may be zero; crest > root.')
    if rr<=(t+gap)/2+tol: raise ValueError('Thread root must be wider than the mating slot.')
    if (rc-rr)/math.sqrt(3)>=pitch/2:raise ValueError('Thread depth exceeds the 60-degree profile limit.')
    phase_x=number(GridPhaseX,0.0);phase_y=number(GridPhaseY,0.0)
    if any(math.isnan(p) or math.isinf(p) or abs(p)>1.0 for p in [phase_x,phase_y]):
        raise ValueError('GridPhaseX and GridPhaseY must be between -1 and 1; 0 centers the section grid.')
    remove_edges=boolean(RemoveNarrowEdges);edge_ratio=number(EdgeWidthRatio,0.78)
    if math.isnan(edge_ratio) or math.isinf(edge_ratio) or not 0.0<=edge_ratio<=1.0:
        raise ValueError('EdgeWidthRatio must be between 0 and 1; 0.78 means 78% of the original unit width.')
    model=seq(Model);open_roof=False;grid_info={};phase_scale=1.0
    if not model and (phase_x or phase_y):
        raise ValueError('Connect Model to change the section-grid phase; existing A/B curves cannot be re-sliced without their model.')
    for geo in model:
        if isinstance(geo,rg.Surface):geo=geo.ToBrep()
        if isinstance(geo,rg.Brep) and not geo.IsSolid:open_roof=True
        if isinstance(geo,rg.Mesh) and not geo.IsClosed:open_roof=True
    if model:A,B,grid_info,phase_scale=phase_sections(model,gs,tol,base_depth,phase_x,phase_y,max(rr,t/2.0)+2*tol,rr,max(t,dy),level,open_roof)
    aa=panels(A,'A',tol);bb=panels(B,'B',tol)
    if not aa or not bb: raise ValueError('Connect both orthogonal sets of section curves to A and B.')
    count=0;skipped=0;pairs=[]
    for a in aa:
        for b in bb:
            ai=intervals(a['loops'],b['fixed'],tol);bi=intervals(b['loops'],a['fixed'],tol)
            for lo,hi in ai:
                for lo2,hi2 in bi:
                    bottom=max(lo,lo2);top=min(hi,hi2)
                    if top-bottom<=max(2.0,level):continue
                    meet=top-level
                    if open_roof:
                        # Lowering the common floor can expose new intersections
                        # near the roof footprint's edge. A center-line overlap
                        # alone does not guarantee room for a full-width neck.
                        try:
                            na=attachment_top(a['loops'],b['fixed'],bottom,rr,max(t,dy),tol)
                            nb=attachment_top(b['loops'],a['fixed'],bottom,rr,max(t,dy),tol)
                        except ValueError:
                            skipped+=1;continue
                        a.setdefault('attachments',{})[(b['fixed'],bottom)]=na
                        b.setdefault('attachments',{})[(a['fixed'],bottom)]=nb
                    a['joints'].append((b['fixed'],bottom,top,meet))
                    b['joints'].append((a['fixed'],bottom,top,meet));count+=1
                    pairs.append((a,b,bottom,top,meet))
    templates=seq(Pattern)
    # Both families use the opposite family's common grid as their horizontal
    # phase, including panels whose edge joints were omitted for lack of room.
    if abs(period-gs)>tol and templates and max(q.GetBoundingBox(True).Max.X-q.GetBoundingBox(True).Min.X for q in templates)>period+tol:
        raise ValueError('Pattern is wider than UnitPeriod. Rebuild the original tangent-arc Pattern with the same UnitPeriod; do not change only the array spacing.')
    origins={'A':min(p['fixed'] for p in bb)-period/4,
             'B':min(p['fixed'] for p in aa)-period/4}
    row_offset=0.0
    bottoms=[bottom for p in aa+bb for u,bottom,top,meet in p['joints']]
    if top_only and bottoms and max(bottoms)-min(bottoms)<=tol:
        # A single translation for all rows, packing against the common flat
        # root collar while keeping the input Dy and the original stagger.
        row_offset=(max(bottoms)+max(root_margin,max(t,dy)+3*tol)+3*tol)%dy
    original_count=count;edge_details=[]
    if remove_edges:
        widths=[q.GetBoundingBox(True).Max.X-q.GetBoundingBox(True).Min.X for q in templates if isinstance(q,rg.Curve)]
        if not widths or max(widths)<=tol:raise ValueError('Connect a valid original Pattern to measure the narrow-edge threshold.')
        unit_width=max(widths)
        for panel in aa+bb:
            for side,width,axis in narrow_edge_joints(panel,unit_width,edge_ratio,(t+gap)/2):
                edge_details.append('%s at %.3f: %s bay %.3f mm < %.3f mm; joint axis %.3f removed'%(panel['kind'],panel['fixed'],side,width,unit_width*edge_ratio,axis))
        # Cancel both mating features for an omitted joint. Neither panel's
        # boundary is clipped; this mode changes the joint layout only.
        for panel in aa+bb:
            panel['original_joint_axes']=sorted(j[0] for j in panel['joints'])
            panel['joints']=[]
        count=0
        for a,b,bottom,top,meet in pairs:
            if b['fixed'] in a.get('removed_axes',set()) or a['fixed'] in b.get('removed_axes',set()):continue
            a['joints'].append((b['fixed'],bottom,top,meet))
            b['joints'].append((a['fixed'],bottom,top,meet));count+=1
    grid_preview=section_grid_preview(aa+bb,t,tol)
    profilesA=[];profilesB=[];assembly=[];cut2d=[];features=[];cursor=0.0;details=[];split_panels=0;filled_units=0
    for panel in aa+bb:
        loops=panel['loops'];pb=bounds(loops);kind=panel['kind'];tabs=[];slots=[];slot_ends=[];rails=[];witnesses=[]
        axes=panel.get('original_joint_axes',sorted(j[0] for j in panel['joints']))
        for u,bottom,top,meet in panel['joints']:
            phase=0.0 if kind=='A' else 0.25
            embed=max(t,dy)
            neck_top=panel.get('attachments',{}).get((u,bottom))
            if neck_top is None:neck_top=attachment_top(loops,u,bottom,rr,embed,tol)
            if tune and kind=='A':
                index=axes.index(u)
                x0=pb.Min.X if index==0 else (axes[index-1]+u)/2
                x1=pb.Max.X if index==len(axes)-1 else (u+axes[index+1])/2
                relief=max(13.0*rr/4.6,rc+tol)
                feature=short_head_tab(u,bottom,phase,total,neck_length,head_length,pitch,rr,rc,neck_top,x0,x1,relief,tol)
                witness_y=bottom-total+(neck_length+head_length)/2
            else:
                # The standard long member is threaded to the tip. SmoothLength
                # remains the retained starter length when Tunable is disabled.
                feature=tab(u,bottom,phase,total if tune else 0.0,0.0 if tune else smooth,pitch,rr,rc,tune,neck_top)
                witness_y=bottom-total/2
            tabs.append(feature)
            # Protect the entire neck, including both prongs after the lap slot
            # is cut. Otherwise the lattice subtraction can sever the new joint.
            root_top=max(neck_top+tol,bottom+root_margin)
            rails.append(rect(u-rr-tol,bottom-tol,u+rr+tol,root_top))
            # On a curved panel, other columns can lie below this joint's root.
            # The global lattice bounding box therefore also covers the thread.
            # Exclude its full footprint, including tooth crests and smooth tip.
            radius=max(rr,rc)+tol
            tip=bottom-total
            rails.append(rect(u-radius,tip-tol,u+radius,bottom+tol))
            w=(t+gap)/2
            for side in [-1,1]:witnesses.append(rg.Point3d(u+side*(rr+w)/2,witness_y,0))
            slot_ends.append(rg.LineCurve(rg.Point3d(u-w,meet,0),rg.Point3d(u+w,meet,0)))
            if kind=='A':
                slots.append(rect(u-w,meet,u+w,pb.Max.Y+1))
            else:
                slots.append(rect(u-w,bottom-total-1,u+w,meet))
            q=feature.DuplicateCurve();q.Transform(rg.Transform.PlaneToPlane(rg.Plane.WorldXY,panel['plane']));features.append(q)
        # Protect root/thread collars only; no slot-wall or perimeter rails.
        protection=boolean_union(rails,tol) if rails else []
        holes=pattern_holes(loops,templates,period,2*dy,tol,origins[kind],row_offset)
        holes=top_margin_holes(holes,loops,top_margin,top_only,tol)
        before_root_band=len(holes)
        holes=root_margin_holes(holes,loops,root_margin,tol)
        rejected_root_band=before_root_band-len(holes)
        holes=[h for h in holes if clear_of_root_margin(h,protection,tol)]
        outer=boolean_union(loops+tabs,tol) if tabs else loops
        before_slots=len(holes)
        holes,actual_slot_ends=isolate_slot_end_cutouts(holes,slot_ends,outer,tol)
        rejected_slots=before_slots-len(holes)
        # Preserve complete slot ends; scalloped openings along the side walls
        # remain permitted. Suppression never changes the original lattice.
        try:
            holes,rejected_fragments,result=suppress_fragmenting_cutouts(outer,slots,holes,tol,witnesses,row_offset>tol)
            filled_units+=rejected_fragments
        except ValueError as error:
            raise ValueError('%s panel at %.3f: %s'%(kind,panel['fixed'],error))
        result,chips=remove_boundary_chips(result,t*t,tol,witnesses,loops)
        # Preserve the accepted whole-cell Boolean result without adding
        # slot-wall or perimeter strips.
        missing,split=connection_state(result,witnesses,tol,outer)
        piece_count=len(rg.Brep.CreatePlanarBreps(Array[rg.Curve](result),tol) or [])
        if split or missing:split_panels+=1
        local=result
        world=[]
        for c in local:
            q=c.DuplicateCurve();q.Transform(rg.Transform.PlaneToPlane(rg.Plane.WorldXY,panel['plane']));world.append(q)
        if kind=='A':profilesA.extend(world)
        else:profilesB.extend(world)
        fb=bounds(local)
        for c in local:
            q=c.DuplicateCurve();q.Transform(rg.Transform.Translation(cursor-fb.Min.X,-fb.Min.Y,0));cut2d.append(q)
        cursor+=fb.Max.X-fb.Min.X+5.0
        surfaces=rg.Brep.CreatePlanarBreps(Array[rg.Curve](world),tol)
        if surfaces is None:raise ValueError('Cannot make planar panels from the generated closed contours.')
        normal=panel['plane'].Normal
        for s in surfaces:
            s.Transform(rg.Transform.Translation(normal*(-t/2)))
            path=rg.LineCurve(rg.Point3d.Origin,rg.Point3d(normal*t))
            solid=s.Faces[0].CreateExtrusion(path,True)
            if solid is None or not solid.IsValid or not solid.IsSolid:raise ValueError('Panel extrusion is not a valid closed solid.')
            if solid.SolidOrientation==rg.BrepSolidOrientation.Inward:solid.Flip()
            assembly.append(solid)
        details.append('%s: %d joint(s), %d cutout(s)'%(kind,len(panel['joints']),len(holes))+'; %d boundary chip(s) removed; %d material piece(s)'%(chips,piece_count)+'; %d slot-end-conflicting unit(s) suppressed'%rejected_slots+'; %d root-band unit(s) suppressed'%rejected_root_band+'; %d fragmenting unit(s) filled solid'%rejected_fragments)
    if original_count==0:raise ValueError('The A/B section sets have no usable vertical overlap.')
    joint_description=('standard tunable pair: A %.3f mm smooth neck + %.3f mm short thread; B %.3f mm full thread; aligned tips'%(neck_length,head_length,total)) if tune else ('smooth starter %.3f mm only'%smooth)
    report='Tunable=%s | %d intersections | %s | pitch %.3f mm | %d section panels / %d closed material pieces | top margin %.3f mm (%s), root margin %.3f mm | open base depth %.3f mm\n%s'%(tune,count,joint_description,pitch,len(aa+bb),len(assembly),top_margin,'apex only' if top_only else 'follow contour',root_margin,base_depth,'\n'.join(details))
    report+='\nUniform lattice period: %.3f mm horizontally, %.3f mm vertically; section-grid spacing %.3f mm; original tangent-arc Pattern rebuilt upstream and translated without scaling.'%(period,2*dy,gs)
    report+='\nAnti-fragment cutouts: %d whole unit(s) filled solid to prevent new disconnected material pieces; original source bodies and structural slots preserved.'%filled_units
    if remove_edges:
        report+='\nEdge-joint omission ON: threshold %.3f x unit width %.3f = %.3f mm; %d narrow edge(s), %d paired joint(s) omitted; all %d complete panel outlines retained. Original lattice continues across omitted joint axes.'%(edge_ratio,unit_width,unit_width*edge_ratio,len(edge_details),original_count-count,len(aa+bb))
        if edge_details:report+='\n'+'\n'.join(edge_details)
        if original_count>count:report+='\nOmitted joints have no mating slots in either retained sheet. Their sheet envelopes still cross in Assembly; this mode does not resolve assembly interference.'
        unjoined=sum(not p['joints'] for p in aa+bb)
        if unjoined:report+='\n%d retained panel(s) have no remaining joint; they are separate sheets. Reduce the threshold or adjust grid phase if connections are required.'%unjoined
    if grid_info:
        report+='\nSection-grid phase: X %.3f (shift %.3f mm, range +/-%.3f mm, %d B planes); Y %.3f (shift %.3f mm, range +/-%.3f mm, %d A planes).'%(phase_x,grid_info['B']['shift'],grid_info['B']['travel'],grid_info['B']['count'],phase_y,grid_info['A']['shift'],grid_info['A']['travel'],grid_info['A']['count'])
    if phase_scale<1.0:report+='\nPhase travel limited by the model footprint to %.2f%% of the requested translation; section count and spacing retained.'%(100.0*phase_scale)
    if split_panels:report+='\nNo added rails: %d panel(s) contain separate material pieces.'%split_panels
    if skipped:report+='\nSkipped %d edge intersection(s): insufficient roof footprint for a full-width joint neck.'%skipped
    return profilesA,profilesB,assembly,cut2d,features,report,grid_preview

# Grasshopper entry point. No disk access, Rhino document edits, or network access.
if 'ghenv' in globals():
    try:
        ProfilesA,ProfilesB,Assembly,Cut2D,Features,Report,GridPreview=generate(A,B,Pattern,Tunable,GridSpacing,Dy,ZLevel,ThreadLength,SmoothLength,Thickness,Clearance,Pitch,RootRadius,CrestRadius,Tolerance,Model,TopMargin,RootMargin,TopOnly,OpenBaseDepth,ShortThreadLength,NeckLength,GridPhaseX,GridPhaseY,RemoveNarrowEdges,EdgeWidthRatio,UnitPeriod)
    except Exception as error:
        ProfilesA=[];ProfilesB=[];Assembly=[];Cut2D=[];Features=[];GridPreview=[];Report=str(error)
        import Grasshopper.Kernel as ghk
        ghenv.Component.AddRuntimeMessage(ghk.GH_RuntimeMessageLevel.Error,Report)
# ---------- end ff_joint ----------
export_as = ExportAs(Geometry=ff_joint.Cut2D, Overwrite=Toggle(True), Export=False, CompMode=False, LastSaveLocalization="neutral,N")  # -> OK, ExportCommand
stream_filter_2 = StreamFilter(
    Gate=dk_tab_control_2.Value,
    Stream0=geometry,
    Stream1=ff_joint.GridPreview,
    Stream2=ff_joint.Assembly,
    Stream3=ff_joint.Assembly)
custom_preview = CustomPreview(Geometry=stream_filter_2, Material=colour_picker_2)
export_as_2 = ExportAs(
    Geometry=ff_joint.Cut2D,
    FileLocation=dk_text_box.Value,
    Overwrite=True,
    Options=dxf_export_option,
    Export=dk_button_3.Value,
    CompMode=False,
    LastSaveLocalization="neutral,N")  # -> OK, ExportCommand
assembly_bake_this_for_3d = AssemblyBakeThisFor3D(ff_joint.Assembly)
generation_report = Panel(ff_joint.Report)
cut2d_bake_this_for_laser_cutting = Cut2DBakeThisForLaserCutting(ff_joint.Cut2D)
